# Grasshopper definition AttractorPoint_LunchBox_WSII_2019.gh (Grasshopper 1.0.7)
# plug-ins: Bifocals, LunchBox

xz_plane = XZPlane(Origin=Point(0, 0, 0))
radians = Radians(Degrees="180")
unit_y = UnitY(Factor=Slider(58, range=0..100))
arc = Arc(Plane=xz_plane, Radius=Slider(22, range=0..100), Angle=radians)  # -> Arc, Length
move = Move(Geometry=arc.Arc, Motion=unit_y)  # -> Geometry, Transform
scale_nu = ScaleNU(
    Geometry=move.Geometry,
    Plane=PlaneXY(0, 0, 0),
    ScaleX=Slider(1.7, range=1..3),
    ScaleY=Slider(1.4, range=1..3),
    ScaleZ=Slider(1.8, range=1..3))  # -> Geometry, Transform
# Scale NU
scale_nu_2 = ScaleNU(Geometry=arc.Arc, Plane=PlaneXY(0, 0, 0), ScaleX=Slider(1.7, range=1..3), ScaleY=1, ScaleZ=Slider(1.6, range=1..3))  # -> Geometry, Transform
loft = Loft(
    Curves=[scale_nu_2.Geometry, scale_nu.Geometry],
    Options={Adjust=False, Closed=False, LoftEnds=0, LoftSimp=0, LoftType=0, Rebuild=10, Refit=0.01})
# TOOLBOX!
hexagon_cells = HexagonCells(Surface=loft, UDivisions=Slider(33, range=0..100), VDivisions=Slider(33, range=0..100), TParameter=0.25)  # -> HexagonCells, Centers
number_slider = Slider(33, range=0..100)
scale = Scale(Geometry=hexagon_cells.HexagonCells, Center=hexagon_cells.Centers, Factor=Slider(0.7, range=0..1))  # -> Geometry, Transform
merge = Merge(Data1=graft(hexagon_cells.HexagonCells), Data2=graft(scale.Geometry))
point = Point(Point(-44.80305642, 43, 17.92241331))
sphere = Sphere(Base=point, Radius=Slider(5, range=0..10))
distance = Distance(PointA=hexagon_cells.Centers, PointB=point)
bounds = Bounds(Numbers=distance)
custom_preview = CustomPreview(Geometry=sphere, Material=ColourSwatch(SwatchColor=RGB(56, 118, 255)))
construct_domain = ConstructDomain(DomainStart=Slider(0.2, range=0..1), DomainEnd=Slider(1.2, range=0..10))
remap_numbers = RemapNumbers(Value=distance, Source=bounds, Target=construct_domain)  # -> Mapped, Clipped
scale_2 = Scale(Geometry=scale.Geometry, Center=hexagon_cells.Centers, Factor=remap_numbers.Mapped)  # -> Geometry, Transform
surface_closest_point = SurfaceClosestPoint(Point=hexagon_cells.Centers, Surface=loft)  # -> Point, UVPoint, Distance
number_slider_2 = Slider(10, range=0..10)
evaluate_surface = EvaluateSurface(Surface=loft, Point=surface_closest_point.UVPoint)  # -> Point, Normal, UDirection, VDirection, Frame
negative = Negative(Value=number_slider_2)
multiplication = Multiplication(A=evaluate_surface.Normal, B=number_slider_2)
move_2 = Move(Geometry=scale_2.Geometry, Motion=multiplication)  # -> Geometry, Transform
merge_2 = Merge(Data1=graft(scale.Geometry), Data2=graft(move_2.Geometry))
loft_2 = Loft(Curves=merge, Options={Adjust=False, Closed=False, LoftEnds=0, LoftSimp=0, LoftType=0, Rebuild=10, Refit=0.01})
loft_3 = Loft(Curves=merge_2, Options={Adjust=False, Closed=False, LoftEnds=0, LoftSimp=0, LoftType=0, Rebuild=10, Refit=0.01})
custom_preview_2 = CustomPreview(
    Geometry=loft_3,
    Material={diffuse=RGB(221, 160, 221), emission=RGB(66, 48, 66), shine=0.5, specular=RGB(255, 255, 255), transparency=0})
brep_join = BrepJoin(Breps=loft_2)  # -> Breps, Closed
custom_preview_3 = CustomPreview(Geometry=loft_2, Material=ColourSwatch(SwatchColor=RGB(255, 255, 255)))
