# Grasshopper definition Box_Morph_Wheel_WSII_2019 (1).gh (Grasshopper 1.0.7)
# plug-ins: Bifocals

xz_plane = XZPlane(Origin=Point(0, 0, 0))
radians = Radians(Degrees="180")
arc = Arc(Plane=xz_plane, Radius=Slider(33, range=0..100), Angle=radians)  # -> Arc, Length
end_points = EndPoints(Curve=arc.Arc)  # -> Start, End
ellipse = Ellipse(Plane=end_points.Start, Radius1=Slider(8, range=0..100), Radius2=Slider(15, range=0..100))  # -> Ellipse, Focus1, Focus2
sweep1 = Sweep1(Rail=arc.Arc, Sections=ellipse.Ellipse, Miter=1)
divide_domain² = DivideDomain²(Domain=sweep1, UCount=Slider(33, range=0..100), VCount=Slider(33, range=0..100))
construct_domain = ConstructDomain(DomainStart=Slider(-4, range=-6..1), DomainEnd=Slider(5, range=0..10))
list_length = ListLength(List=divide_domain²)
random = Random(Range=construct_domain, Number=list_length, Seed=Slider(1, range=0..10))
center_box = CenterBox(Base=PlaneXY(0, 0, 0), X=1, Y=1, Z=1)
surface_box = SurfaceBox(Surface=sweep1, Domain=divide_domain², Height=random)
bounding_box = BoundingBox(Content=center_box, Plane=PlaneXY(0, 0, 0))  # -> Box, Box_2
box_morph = BoxMorph(Geometry=center_box, Reference=bounding_box.Box, Target=surface_box)
