# Grasshopper definition BrepPlane_WSII_2019 (1).gh (Grasshopper 1.0.7)
# plug-ins: Bifocals

number_slider = Slider(29, range=0..100)
number_slider_2 = Slider(0, range=0..100)
series = Series(Start=number_slider_2, Step=Slider(15, range=0..100), Count=number_slider)
ellipse = Ellipse(Plane=PlaneXY(0, 0, 0), Radius1=Slider(21, range=0..100), Radius2=Slider(44, range=0..100))  # -> Ellipse, Focus1, Focus2
unit_z = UnitZ(Factor=series)
subtraction = Subtraction(A=number_slider, B=Slider(1, range=0..1))
area = Area(Geometry=ellipse.Ellipse)  # -> Area, Centroid
move = Move(Geometry=ellipse.Ellipse, Motion=unit_z)  # -> Geometry, Transform
division = Division(A=Slider(11, range=0..100), B=subtraction)
line_sdl = LineSDL(Start=area.Centroid, Direction=unit_z, Length=Slider(41, range=0..100))
radians = Radians(Degrees=division)
construct_domain = ConstructDomain(DomainStart=Slider(1, range=0..1), DomainEnd=Slider(4, range=0..10))
series_2 = Series(Start=number_slider_2, Step=radians, Count=number_slider)
subtraction_2 = Subtraction(A=number_slider, B=Slider(1, range=0..1))
unit_x = UnitX(Factor=Slider(100, range=0..100))
rotate_axis = RotateAxis(Geometry=move.Geometry, Angle=series_2, Axis=line_sdl)  # -> Geometry, Transform
range = Range(Domain=construct_domain, Steps=subtraction_2)
move_2 = Move(Geometry=rotate_axis.Geometry, Motion=unit_x)  # -> Geometry, Transform
area_2 = Area(Geometry=rotate_axis.Geometry)  # -> Area, Centroid
area_3 = Area(Geometry=move_2.Geometry)  # -> Area, Centroid
graph_mapper = GraphMapper(
    range,
    x0=0,
    x1=1,
    y0=0,
    y1=1,
    container_name="Sine",
    Equation_px=[0.5164785981, 0.8521737456],
    Equation_py=[0.2227840424, 0.6652172804])
graph_mapper_2 = GraphMapper(
    range,
    x0=0,
    x1=1,
    y0=0,
    y1=1,
    container_name="Sine",
    Equation_px=[0.5796959996, 0.8534448743],
    Equation_py=[0.5724938512, 0.7235275507])
multiplication = Multiplication(A=graph_mapper_2, B=Slider(2, range=0..10))
scale = Scale(Geometry=rotate_axis.Geometry, Center=area_2.Centroid, Factor=multiplication)  # -> Geometry, Transform
multiplication_2 = Multiplication(A=graph_mapper, B=Slider(2, range=0..10))
scale_2 = Scale(Geometry=move_2.Geometry, Center=area_3.Centroid, Factor=multiplication_2)  # -> Geometry, Transform
boundary_surfaces = BoundarySurfaces(Edges=scale_2.Geometry)
boundary_surfaces_2 = BoundarySurfaces(Edges=scale.Geometry)
unit_z_2 = UnitZ(Factor=Slider(0.22, range=0..1))
geometry = Geometry([boundary_surfaces, boundary_surfaces_2])
brep_edges = BrepEdges(Brep=geometry)  # -> flatten(Naked), Interior, NonManifold
split_list = SplitList(List=brep_edges.Naked, Index=number_slider)  # -> ListA, ListB
curve = Curve(brep_edges.Naked)
unit_z_3 = UnitZ(Factor=Slider(1.5, range=0..10))
panel = Panel(brep_edges.Naked)
area_4 = Area(Geometry=split_list.ListB)  # -> Area, Centroid
area_5 = Area(Geometry=split_list.ListA)  # -> Area, Centroid
scale_3 = Scale(Geometry=split_list.ListB, Center=area_4.Centroid, Factor=Slider(0.66, range=0..1))  # -> Geometry, Transform
scale_4 = Scale(Geometry=split_list.ListA, Center=area_5.Centroid, Factor=Slider(0.66, range=0..1))  # -> Geometry, Transform
loft = Loft(
    Curves=scale_4.Geometry,
    Options={Adjust=False, Closed=False, LoftEnds=0, LoftSimp=0, LoftType=0, Rebuild=10, Refit=0.01})
loft_2 = Loft(
    Curves=scale_3.Geometry,
    Options={Adjust=False, Closed=False, LoftEnds=0, LoftSimp=0, LoftType=0, Rebuild=10, Refit=0.01})
extrude = Extrude(Base=curve, Direction=unit_z_3)
extrude_2 = Extrude(Base=geometry, Direction=unit_z_2)
brep_join = BrepJoin(Breps=[loft_2, loft])  # -> Breps, Closed
