# Grasshopper definition BrepPlane_WSII_2019 (2).gh (Grasshopper 1.0.7)
# plug-ins: Bifocals

# Extract Pt of Origin
origin = Origin(Point(0, 0, 14.5561136))
xy_plane = XYPlane(Origin=origin)
md_slider = MDSlider(
    SliderMode=0,
    slider_value=Point(0.7867848466, 0.6266330626, 0.5),
    x_domain=Domain(0, 1),
    y_domain=Domain(0, 1),
    z_domain=Domain(0, 1))
# Extract Pt of Origin
md_slider_2 = MDSlider(SliderMode=0, slider_value=Point(1, 1, 0.5), x_domain=Domain(0, 1), y_domain=Domain(0, 1), z_domain=Domain(0, 1))
md_slider_3 = MDSlider(SliderMode=0, slider_value=Point(0, 0, 0.5), x_domain=Domain(0, 1), y_domain=Domain(0, 1), z_domain=Domain(0, 1))
surface = Surface(reparameterize(<surface referenced from the Rhino model>))
md_slider_4 = MDSlider(
    SliderMode=0,
    slider_value=Point(0.523370138, 0.4363894579, 0.5),
    x_domain=Domain(0, 1),
    y_domain=Domain(0, 1),
    z_domain=Domain(0, 1))
md_slider_5 = MDSlider(SliderMode=0, slider_value=Point(0, 1, 0.5), x_domain=Domain(0, 1), y_domain=Domain(0, 1), z_domain=Domain(0, 1))
md_slider_6 = MDSlider(SliderMode=0, slider_value=Point(1, 0, 0.5), x_domain=Domain(0, 1), y_domain=Domain(0, 1), z_domain=Domain(0, 1))
md_slider_7 = MDSlider(
    SliderMode=0,
    slider_value=Point(0.7867848466, 0.6266330626, 0.5),
    x_domain=Domain(0, 1),
    y_domain=Domain(0, 1),
    z_domain=Domain(0, 1))
md_slider_8 = MDSlider(SliderMode=0, slider_value=Point(1, 1, 0.5), x_domain=Domain(0, 1), y_domain=Domain(0, 1), z_domain=Domain(0, 1))
md_slider_9 = MDSlider(SliderMode=0, slider_value=Point(0, 0, 0.5), x_domain=Domain(0, 1), y_domain=Domain(0, 1), z_domain=Domain(0, 1))
surface_2 = Surface(reparameterize(<surface referenced from the Rhino model>))
curve_on_surface = CurveOnSurface(Surface=surface, UVCoordinates=[md_slider_2, md_slider, md_slider_3], Closed=False)  # -> Curve, Length, Domain
curve_on_surface_2 = CurveOnSurface(Surface=surface, UVCoordinates=[md_slider_5, md_slider_4, md_slider_6], Closed=False)  # -> Curve, Length, Domain
curve_on_surface_3 = CurveOnSurface(Surface=surface_2, UVCoordinates=[md_slider_8, md_slider_7, md_slider_9], Closed=False)  # -> Curve, Length, Domain
perp_frames = PerpFrames(Curve=curve_on_surface.Curve, Count=Slider(28, range=0..100), Align=True)  # -> Frames, Parameters
perp_frames_2 = PerpFrames(Curve=curve_on_surface_2.Curve, Count=Slider(28, range=0..100), Align=True)  # -> Frames, Parameters
range = Range(Domain=Domain(0, 1), Steps=Slider(69, range=0..100))
brep_plane = BrepPlane(Brep=surface, Plane=perp_frames_2.Frames)  # -> Curves, Points
graph_mapper = GraphMapper(
    range,
    x0=0,
    x1=1,
    y0=0,
    y1=1,
    container_name="Bezier",
    cpx=[0, 0.8885781169, 0.1947906017, 1],
    cpy=[0, 0, 0.8184336424, 1])
brep_plane_2 = BrepPlane(Brep=surface, Plane=perp_frames.Frames)  # -> Curves, Points
perp_frame = PerpFrame(Curve=reparameterize(curve_on_surface_3.Curve), Parameter=graph_mapper)
brep_plane_3 = BrepPlane(Brep=surface_2, Plane=perp_frame)  # -> Curves, Points
