# Grasshopper definition Bricks_Timber_WSII_2019.gh (Grasshopper 1.0.7)
# plug-ins: Bifocals

number_slider = Slider(8, range=0..48)
xy_plane = XYPlane(Origin=Point(0, 0, 0))
polygon = Polygon(Plane=xy_plane, Radius=Slider(149, range=0..400), Segments=number_slider, FilletRadius=0)  # -> Polygon, Length
# New: Move Away From
# 
# can use Area centroid or flating point
area = Area(Geometry=polygon.Polygon)  # -> Area, Centroid
explode = Explode(Curve=polygon.Polygon, Recursive=True)  # -> Segments, Vertices
point = Point(<point referenced from the Rhino model>)
number_slider_2 = Slider(0, range=0..100)
geometry = Geometry(explode.Segments)
number_slider_3 = Slider(0, range=0..100)
move_away_from = MoveAwayFrom(Geometry=geometry, Emitter=point, Distance=Slider(40, range=0..40))  # -> Geometry, Transform
number_slider_4 = Slider(1, range=0..100)
divide_curve = DivideCurve(Curve=move_away_from.Geometry, Count=Slider(1, range=0..1), Kinks=False)  # -> Points, Tangents, Parameters
divide_curve_2 = DivideCurve(Curve=geometry, Count=Slider(1, range=0..1), Kinks=False)  # -> Points, Tangents, Parameters
line = Line(StartPoint=divide_curve_2.Points, EndPoint=divide_curve.Points)
loft = Loft(Curves=line, Options={Adjust=False, Closed=False, LoftEnds=0, LoftSimp=0, LoftType=0, Rebuild=10, Refit=0.01})
unit_z = UnitZ(Factor=Slider(10, range=0..10))
extrude = Extrude(Base=loft, Direction=unit_z)
linear_array = LinearArray(Geometry=extrude, Direction=unit_z, Count=Slider(14, range=0..100))  # -> Geometry, Transform
integer = Integer(180)
panel = Panel("""0
1""")
division = Division(A=integer, B=number_slider)
dispatch = Dispatch(List=linear_array.Geometry, DispatchPattern=panel)  # -> ListA, ListB
radians = Radians(Degrees=division)
unit_z_2 = UnitZ(Factor=1)
geometry_2 = Geometry(dispatch.ListA)
rotate_3d = Rotate3D(Geometry=geometry_2, Angle=radians, Center=area.Centroid, Axis=unit_z_2)  # -> Geometry, Transform
geometry_3 = Geometry(dispatch.ListB)
