# Grasshopper definition BrushSimulation.gh (Grasshopper 0.9.80)
# plug-ins: Bifocals

number_slider = Slider(12, range=0..100)
number_slider_2 = Slider(12, range=0..100)
number_slider_3 = Slider(3, range=1..3)
range = Range(Domain=number_slider, Steps=10)
construct_point = ConstructPoint(XCoordinate=range, YCoordinate=graft(range), ZCoordinate=0)  # -> flatten(Point)
md_slider = MDSlider(
    slider_value=Point(0.6707320795, 0.6300811768, 0.5),
    SliderMode=0,
    x_domain=Domain(0, 1),
    y_domain=Domain(0, 1),
    z_domain=Domain(0, 1))
surface_from_points = SurfaceFromPoints(Points=construct_point, UCount=expr("x-1", number_slider), Interpolate=True)
area = Area(Geometry=surface_from_points)  # -> Area, Centroid
evaluate_surface = EvaluateSurface(Surface=reparameterize(surface_from_points), Point=md_slider)  # -> Point, Normal, Frame
divide_domain² = DivideDomain²(Domain=surface_from_points, UCount=number_slider_2, VCount=number_slider_2)
geometry = Geometry(evaluate_surface.Point)
isotrim = Isotrim(Surface=surface_from_points, Domain=divide_domain²)
md_slider_2 = MDSlider(
    slider_value=Point(0.5546459761, 0.4791665077, 0.5),
    SliderMode=0,
    x_domain=Domain(0, 1),
    y_domain=Domain(0, 1),
    z_domain=Domain(0, 1))
evaluate_surface_2 = EvaluateSurface(Surface=reparameterize(isotrim), Point=md_slider_2)  # -> Point, Normal, Frame
unit_z = UnitZ(Factor=Slider(12, range=0..100))
move = Move(Geometry=evaluate_surface_2.Point, Motion=unit_z)  # -> graft(Geometry), Transform
flip_matrix = FlipMatrix(Data=construct_point)
scale = Scale(Geometry=move.Geometry, Center=area.Centroid, Factor=number_slider_3)  # -> flatten(Geometry), Transform
scale_2 = Scale(Geometry=move.Geometry, Center=area.Centroid, Factor=number_slider_3)  # -> graft(Geometry), Transform
list_item = ListItem(List=scale.Geometry, Index=Slider(23, range=0..144), Wrap=True)
unit_z_2 = UnitZ(Factor=1)
arc_sed = ArcSED(Start=area.Centroid, End=list_item, Direction=unit_z_2)  # -> Arc, Plane, Radius
line = Line(StartPoint=flip_matrix, EndPoint=scale_2.Geometry)
bend_deform = BendDeform(Geometry=line, BendingArc=arc_sed.Arc)
pipe = Pipe(Curve=line, Radius=Slider(0.107, range=0..2), Caps=0)
