# Grasshopper definition CupolaCart_intermediate_WSII_2019.gh (Grasshopper 1.0.7)
# plug-ins: Bifocals

pattern = Slider(9.205, range=0..12)
diameter = Slider(73, range=0..200)
height = Slider(128, range=0..300)
craziness = Slider(12, range=0..30)
outside_angle = Slider(-12, range=-12..12)
range = Range(Domain=height, Steps=pattern)
sine = Sine(Value=range)
multiplication = Multiplication(A=sine, B=craziness)
construct_point = ConstructPoint(XCoordinate=range, YCoordinate=0, ZCoordinate=multiplication)
interpolate = Interpolate(Vertices=construct_point, Degree=3, Periodic=False, KnotStyle=1)  # -> Curve, Length, Domain
xz_plane = XZPlane(Origin=Point(0, 0, 0))
pi = Pi(Factor=Slider(0.5, range=0..2))
rotate_3d = Rotate3D(Geometry=interpolate.Curve, Angle=pi, Center=Point(0, 0, 0), Axis=xz_plane)  # -> Geometry, Transform
unit_x = UnitX(Factor=diameter)
move = Move(Geometry=rotate_3d.Geometry, Motion=unit_x)  # -> Geometry, Transform
divide_curve = DivideCurve(Curve=move.Geometry, Count=Slider(1, range=0..1), Kinks=False)  # -> Points, Tangents, Parameters
number_slider = Slider(0, range=0..100)
radians = Radians(Degrees=outside_angle)
xz_plane_2 = XZPlane(Origin=Point(0, 0, 0))
list_item = ListItem(List=divide_curve.Points, Index=0, Wrap=True)
construct_point_2 = ConstructPoint(XCoordinate=0, YCoordinate=0, ZCoordinate=0)
construct_point_3 = ConstructPoint(XCoordinate=number_slider, YCoordinate=number_slider, ZCoordinate=Slider(100, range=0..100))
rotate_3d_2 = Rotate3D(Geometry=move.Geometry, Angle=radians, Center=list_item, Axis=xz_plane_2)  # -> Geometry, Transform
line = Line(StartPoint=construct_point_2, EndPoint=construct_point_3)
revolution = Revolution(Curve=rotate_3d_2.Geometry, Axis=line, Domain=Domain(0, 6.283185307))

# ----
# Wheels
wheelface_scale = Slider(1.085, range=0..2)
separate_wheels = Slider(109, range=40..200)
diameter_2 = Slider(105, range=0..200)
hole_slider = Slider(85, range=0..100)
hole_radii = Slider(14, range=0..100)
thickness = Slider(33, range=0..100)
of_holes = Slider(5, range=0..10)
angle_wheels = Slider(0.46, range=0.4..0.6)
circle = Circle(Plane=PlaneXY(0, 0, 0), Radius=hole_radii)
unit_x_2 = UnitX(Factor=hole_slider)
move_2 = Move(Geometry=circle, Motion=unit_x_2)  # -> Geometry, Transform
unit_z = UnitZ(Factor=thickness)
polar_array = PolarArray(Geometry=move_2.Geometry, Plane=PlaneXY(0, 0, 0), Count=of_holes, Angle=6.283185307)  # -> Geometry, Transform
move_3 = Move(Geometry=polar_array.Geometry, Motion=unit_z)  # -> Geometry, Transform
area = Area(Geometry=move_3.Geometry)  # -> Area, Centroid
scale = Scale(Geometry=move_3.Geometry, Center=area.Centroid, Factor=wheelface_scale)  # -> Geometry, Transform
circle_2 = Circle(Plane=PlaneXY(0, 0, 0), Radius=diameter_2)
move_4 = Move(Geometry=circle_2, Motion=unit_z)  # -> Geometry, Transform
area_2 = Area(Geometry=move_4.Geometry)  # -> Area, Centroid
scale_2 = Scale(Geometry=move_4.Geometry, Center=area_2.Centroid, Factor=wheelface_scale)  # -> Geometry, Transform
flip_matrix = FlipMatrix(Data=scale.Geometry)
flip_matrix_2 = FlipMatrix(Data=polar_array.Geometry)
boundary_surfaces = BoundarySurfaces(Edges=polar_array.Geometry)
boundary_surfaces_2 = BoundarySurfaces(Edges=circle_2)
boundary_surfaces_3 = BoundarySurfaces(Edges=scale_2.Geometry)
boundary_surfaces_4 = BoundarySurfaces(Edges=scale.Geometry)
loft = Loft(
    Curves=[flip_matrix_2, flip_matrix],
    Options={Adjust=False, Closed=False, LoftEnds=0, LoftSimp=0, LoftType=0, Rebuild=10, Refit=0.01})
loft_2 = Loft(
    Curves=[circle_2, scale_2.Geometry],
    Options={Adjust=False, Closed=False, LoftEnds=0, LoftSimp=0, LoftType=0, Rebuild=10, Refit=0.01})
solid_difference = SolidDifference(BrepsA=boundary_surfaces_3, BrepsB=boundary_surfaces_4)
solid_difference_2 = SolidDifference(BrepsA=boundary_surfaces_2, BrepsB=boundary_surfaces)
pi_2 = Pi(Factor=angle_wheels)
brep_join = BrepJoin(Breps=[solid_difference, loft_2, solid_difference_2, loft])  # -> Breps, Closed
xz_plane_3 = XZPlane(Origin=Point(0, 0, 0))
rotate_3d_3 = Rotate3D(Geometry=brep_join.Breps, Angle=pi_2, Center=Point(0, 0, 0), Axis=xz_plane_3)  # -> Geometry, Transform
unit_x_3 = UnitX(Factor=separate_wheels)
move_5 = Move(Geometry=rotate_3d_3.Geometry, Motion=unit_x_3)  # -> Geometry, Transform
mirror = Mirror(Geometry=move_5.Geometry, Plane=PlaneYZ(0, 0, 0))  # -> Geometry, Transform

# ----
# Well #2
number_slider_2 = Slider(1, range=1..2.77)
# Well
number_slider_3 = Slider(93, range=0..300)
circle_cnr = CircleCNR(Center=area_2.Centroid, Normal=Vector(0, 0, 1), Radius=number_slider_3)
unit_z_2 = UnitZ(Factor=Slider(100, range=0..100))
move_6 = Move(Geometry=circle_cnr, Motion=unit_z_2)  # -> Geometry, Transform
area_3 = Area(Geometry=move_6.Geometry)  # -> Area, Centroid
scale_3 = Scale(Geometry=move_6.Geometry, Center=area_3.Centroid, Factor=number_slider_2)  # -> Geometry, Transform
loft_3 = Loft(
    Curves=[circle_cnr, scale_3.Geometry],
    Options={Adjust=False, Closed=False, LoftEnds=0, LoftSimp=0, LoftType=0, Rebuild=10, Refit=0.01})
cap_holes = CapHoles(Brep=loft_3)

cap_holes_2 = CapHoles(Brep=revolution)
brep_join_2 = BrepJoin(Breps=[move_5.Geometry, mirror.Geometry])  # -> Breps, Closed
