# Grasshopper definition CupolaUnited Feb 3rd.gh (Grasshopper 0.9.80)
# plug-ins: Bifocals

number_slider = Slider(12, range=0..100)
unit_x = UnitX(Factor=1)
circle_cnr = CircleCNR(Center=Point(0, 0, 0), Normal=unit_x, Radius=number_slider)
unit_z = UnitZ(Factor=number_slider)
area = Area(Geometry=circle_cnr)  # -> Area, Centroid
divide_curve = DivideCurve(Curve=circle_cnr, Count=Slider(5, range=0..10), Kinks=False)  # -> Points, Tangents, Parameters
unit_y = UnitY(Factor=1)
line = Line(StartPoint=divide_curve.Points, EndPoint=area.Centroid)
unit_x_2 = UnitX(Factor=Slider(6, range=2..6))
line_sdl = LineSDL(Start=Point(0, 0, 0), Direction=unit_y, Length=1)
join_curves = JoinCurves(Curves=[line, circle_cnr], Preserve=False)
curve = Curve(circle_cnr)
pi = Pi(Factor=Slider(0.055, range=-0.5..0.5))
move = Move(Geometry=join_curves, Motion=unit_x_2)  # -> Geometry, Transform
move_2 = Move(Geometry=curve, Motion=unit_x_2)  # -> Geometry, Transform
area_2 = Area(Geometry=move_2.Geometry)  # -> Area, Centroid
rotate_3d = Rotate3D(Geometry=move.Geometry, Angle=pi, Center=area_2.Centroid, Axis=line_sdl)  # -> Geometry, Transform
unit_x_3 = UnitX(Factor=Slider(1.44, range=0..6))
curve_2 = Curve(rotate_3d.Geometry)
deconstruct = Deconstruct(Point=area_2.Centroid)  # -> XComponent, YComponent, ZComponent
circle_cnr_2 = CircleCNR(Center=Point(0, 0, 0), Normal=Vector(0, 0, 1), Radius=deconstruct.XComponent)
move_3 = Move(Geometry=circle_cnr_2, Motion=unit_z)  # -> Geometry, Transform
offset = Offset(Curve=move_3.Geometry, Distance=Slider(1, range=0..10), Plane=PlaneXY(0, 0, 0), Corners=1)  # -> flatten(Curve)
loft = Loft(
    Curves=[circle_cnr_2, offset],
    Options={Adjust=False, Closed=False, LoftEnds=0, LoftSimp=0, LoftType=0, Rebuild=10, Refit=0.01})
evaluate_curve = EvaluateCurve(Curve=reparameterize(offset), Parameter=Slider(1, range=0..1))  # -> Point, Tangent, Angle
extrude = Extrude(Base=rotate_3d.Geometry, Direction=unit_x_3)
curve_closest_point = CurveClosestPoint(Point=evaluate_curve.Point, Curve=curve_2)  # -> Point, Parameter, Distance
mirror = Mirror(Geometry=rotate_3d.Geometry, Plane=PlaneYZ(0, 0, 0))  # -> Geometry, Transform
list_item = ListItem(List=curve_closest_point.Point, Index=0, Wrap=True)
vector_2pt = Vector2Pt(PointA=evaluate_curve.Point, PointB=list_item, Unitize=False)  # -> Vector, Length
line_sdl_2 = LineSDL(Start=evaluate_curve.Point, Direction=vector_2pt.Vector, Length=Slider(13, range=0..100))
mirror_2 = Mirror(Geometry=line_sdl_2, Plane=PlaneYZ(0, 0, 0))  # -> Geometry, Transform
pipe = Pipe(Curve=[rotate_3d.Geometry, mirror.Geometry, line_sdl_2, mirror_2.Geometry], Radius=Slider(0.55, range=0..1), Caps=0)
