# Grasshopper definition Curve_Attractor_WSII_2019 (1).gh (Grasshopper 1.0.7)
# plug-ins: Bifocals

series = Series(Start=0, Step=Slider(6, range=0..10), Count=Slider(25, range=0..100))
polygon = Polygon(Plane=PlaneXY(0, 0, 0), Radius=3, Segments=Slider(4, range=0..10), FilletRadius=0)  # -> Polygon, Length
unit_x = UnitX(Factor=series)
unit_y = UnitY(Factor=series)
move = Move(Geometry=polygon.Polygon, Motion=unit_x)  # -> Geometry, Transform
cross_reference = CrossReference(ListA=move.Geometry, ListB=unit_y, CrossMode=1)  # -> ListA, ListB
move_2 = Move(Geometry=cross_reference.ListA, Motion=cross_reference.ListB)  # -> Geometry, Transform
# input rhino curve!
curve = Curve(<curve referenced from the Rhino model>)
area = Area(Geometry=move_2.Geometry)  # -> Area, Centroid
curve_closest_point = CurveClosestPoint(Point=area.Centroid, Curve=curve)  # -> Point, Parameter, Distance
bounds = Bounds(Numbers=curve_closest_point.Distance)
construct_domain = ConstructDomain(DomainStart=Slider(0.01, range=0.01..0.11), DomainEnd=Slider(1.492, range=0..5))
remap_numbers = RemapNumbers(Value=curve_closest_point.Distance, Source=bounds, Target=construct_domain)  # -> Mapped, Clipped
scale = Scale(Geometry=move_2.Geometry, Center=area.Centroid, Factor=remap_numbers.Clipped)  # -> Geometry, Transform
multiplication = Multiplication(A=remap_numbers.Mapped, B=Slider(27, range=0..100))
unit_z = UnitZ(Factor=multiplication)
extrude = Extrude(Base=scale.Geometry, Direction=unit_z)
gradient = Gradient(LowerLimit=0, UpperLimit=1, Parameter=remap_numbers.Mapped, stops=[0.15: RGB(40, 31, 160), 0.85: RGB(220, 0, 40)])
custom_preview = CustomPreview(Geometry=extrude, Material=gradient)
