# Grasshopper definition Dispatch_WSII_2019.gh (Grasshopper 1.0.7)
# plug-ins: Bifocals

center_box = CenterBox(Base=PlaneXY(0, 0, 0), X=Slider(84, range=0..100), Y=Slider(96.3, range=0..100), Z=Slider(87.4, range=0..100))
populate_geometry = PopulateGeometry(Geometry=center_box, Count=Slider(202, range=0..400), Seed=Slider(2338, range=0..10000))
octree = OcTree(Points=populate_geometry, Square=Toggle(True), Group=Slider(0, range=0..100))  # -> Boxes, Points
box = Box(octree.Boxes)
random_reduce = RandomReduce(List=box, Reduction=Slider(18, range=0..100), Seed=1)
custom_preview = CustomPreview(
    Geometry=random_reduce,
    Material={diffuse=RGB(221, 160, 221), emission=RGB(66, 48, 66), shine=0.5, specular=RGB(255, 255, 255), transparency=0})
