# Grasshopper definition DockWSII001.gh (Grasshopper 0.9.80)

parameter_on_crv = Slider(0.047, range=0..1)
length = Slider(21, range=0..100)
planks = Slider(36, range=0..100)
plank_width = Slider(0.856, range=0.1..1.5)
plank_height = Slider(0.45, range=0.1..1.5)
radius = Slider(0.14, range=0..1)
post_depth = Slider(6, range=1..6)
post_count1 = Slider(3, range=2..5)
post_count2 = Slider(5, range=2..5)
rail_radius = Slider(0.2, range=0..1)
stilted_height = Slider(5, range=1..5)
box_depth = Slider(10, range=0..100)
box_x_and_y_dim = Slider(35, range=-5..100)
range = Range(Domain=length, Steps=planks)
sine = Sine(Value=range)
cosine = Cosine(Value=range)
multiplication = Multiplication(A=sine, B=cosine)
construct_point = ConstructPoint(XCoordinate=range, YCoordinate=multiplication, ZCoordinate=cosine)
unit_y = UnitY(Factor=construct_point)
move = Move(Geometry=construct_point, Motion=unit_y)  # -> Geometry, Transform
interpolate = Interpolate(Vertices=move.Geometry, Degree=3, Periodic=False, KnotStyle=1)  # -> Curve, Length, Domain
horizontal_frame = HorizontalFrame(Curve=reparameterize(interpolate.Curve), Parameter=parameter_on_crv)
scale_nu = ScaleNU(
    Geometry=move.Geometry,
    Plane=horizontal_frame,
    ScaleX=Slider(1, range=1..5),
    ScaleY=Slider(1, range=1..5),
    ScaleZ=Slider(1.7, range=1..5))  # -> Geometry, Transform
interpolate_2 = Interpolate(Vertices=scale_nu.Geometry, Degree=3, Periodic=False, KnotStyle=1)  # -> Curve, Length, Domain
interpolate_3 = Interpolate(Vertices=construct_point, Degree=3, Periodic=False, KnotStyle=1)  # -> Curve, Length, Domain
divide_curve = DivideCurve(Curve=interpolate_2.Curve, Count=post_count2, Kinks=False)  # -> Points, Tangents, Parameters
xy_plane = XYPlane(Origin=Point(0, 0, 0))
divide_curve_2 = DivideCurve(Curve=interpolate_3.Curve, Count=post_count1, Kinks=False)  # -> Points, Tangents, Parameters
xy_plane_2 = XYPlane(Origin=Point(0, 0, 0))
circle_cnr = CircleCNR(Center=divide_curve.Points, Normal=xy_plane, Radius=radius)  # -> graft(Circle)
circle_cnr_2 = CircleCNR(Center=divide_curve_2.Points, Normal=xy_plane_2, Radius=radius)  # -> graft(Circle)
unit_z = UnitZ(Factor=post_depth)
unit_z_2 = UnitZ(Factor=post_depth)
move_2 = Move(Geometry=circle_cnr, Motion=expr("-x", unit_z))  # -> Geometry, Transform
move_3 = Move(Geometry=circle_cnr_2, Motion=expr("-x", unit_z_2))  # -> Geometry, Transform
loft = Loft(
    Curves=[move_3.Geometry, circle_cnr_2],
    Options={Adjust=False, Closed=False, LoftEnds=0, LoftSimp=0, LoftType=0, Rebuild=10, Refit=0.01})
loft_2 = Loft(
    Curves=[move_2.Geometry, circle_cnr],
    Options={Adjust=False, Closed=False, LoftEnds=0, LoftSimp=0, LoftType=0, Rebuild=10, Refit=0.01})
unit_z_3 = UnitZ(Factor=1)
line = Line(StartPoint=scale_nu.Geometry, EndPoint=construct_point)  # -> graft(Line)
param_viewer = ParamViewer(line)
panel = Panel(line)
unit_x = UnitX(Factor=plank_width)
extrude = Extrude(Base=line, Direction=unit_x)
unit_z_4 = UnitZ(Factor=plank_height)
param_viewer_2 = ParamViewer()

extrude_2 = Extrude(Base=extrude, Direction=unit_z_4)
pipe = Pipe(Curve=interpolate_2.Curve, Radius=rail_radius, Caps=1)
pipe_2 = Pipe(Curve=interpolate_3.Curve, Radius=rail_radius, Caps=1)
cap_holes = CapHoles(Brep=loft_2)

cap_holes_2 = CapHoles(Brep=loft)
brep_join = BrepJoin(Breps=[pipe_2, pipe, cap_holes, extrude_2, cap_holes_2])  # -> Breps, Closed
unit_z_5 = UnitZ(Factor=stilted_height)
plane_surface = PlaneSurface(Plane=PlaneXY(0, 0, 0), XSize=box_x_and_y_dim, YSize=box_x_and_y_dim)
move_4 = Move(Geometry=brep_join.Breps, Motion=unit_z_5)  # -> Geometry, Transform
unit_z_6 = UnitZ(Factor=box_depth)
motion = Motion(Vector(4.742499545, 5.064529381, 0))
surface = Surface(plane_surface)
extrude_3 = Extrude(Base=surface, Direction=expr("-x", unit_z_6))
move_5 = Move(Geometry=move_4.Geometry, Motion=motion)  # -> Geometry, Transform
solid_difference = SolidDifference(BrepsA=move_5.Geometry, BrepsB=extrude_3)
