# Grasshopper definition Fabruary 7th.gh (Grasshopper 0.9.80)
# plug-ins: Bifocals

number_slider = Slider(6, range=0..100)
number_slider_2 = Slider(10, range=0..100)
surface = Surface(reparameterize(<surface referenced from the Rhino model>))
multiplication = Multiplication(A=number_slider, B=number_slider_2)
divide_domain² = DivideDomain²(Domain=surface, UCount=number_slider, VCount=number_slider_2)
deconstruct_domain² = DeconstructDomain²(Domain=divide_domain²)  # -> UComponent, VComponent
graph_mapper = GraphMapper(
    deconstruct_domain².UComponent,
    x0=0,
    x1=1,
    y0=0,
    y1=1,
    container_name="Bezier",
    cpx=[0, 0.4057970941, 0.6014492512, 1],
    cpy=[0, 0.1231883764, 0.7826086879, 1])
graph_mapper_2 = GraphMapper(
    deconstruct_domain².VComponent,
    x0=0,
    x1=1,
    y0=0,
    y1=1,
    container_name="Bezier",
    cpx=[0, 0, 1, 1],
    cpy=[0, 0.6086956263, 0.3333333135, 1])
graph_mapper_3 = GraphMapper(
    deconstruct_domain².UComponent,
    x0=0,
    x1=1,
    y0=0,
    y1=1,
    container_name="Bezier",
    cpx=[0, 0.1811594218, 0.8333333135, 1],
    cpy=[0, 0.710144937, 0.2246376872, 1])
graph_mapper_4 = GraphMapper(
    deconstruct_domain².VComponent,
    x0=0,
    x1=1,
    y0=0,
    y1=1,
    container_name="Bezier",
    cpx=[0, 0.6739130616, 0.7173913121, 1],
    cpy=[0, 0.0434782505, 0.6449275017, 1])
construct_domain² = ConstructDomain²(DomainU=graph_mapper, DomainV=graph_mapper_2)
construct_domain²_2 = ConstructDomain²(DomainU=graph_mapper_3, DomainV=graph_mapper_4)
isotrim = Isotrim(Surface=surface, Domain=construct_domain²)  # -> reparameterize(Surface)
isotrim_2 = Isotrim(Surface=surface, Domain=construct_domain²_2)  # -> reparameterize(Surface)
unit_z = UnitZ(Factor=Slider(54, range=0..100))
move = Move(Geometry=isotrim, Motion=unit_z)  # -> Geometry, Transform
pi = Pi(Factor=Slider(0.16, range=0..2))
rotate_3d = Rotate3D(Geometry=move.Geometry, Angle=pi, Center=Point(0, 0, 0), Axis=Vector(0, 0, 1))  # -> Geometry, Transform
area = Area(Geometry=isotrim_2)  # -> Area, flatten(Centroid)
area_2 = Area(Geometry=rotate_3d.Geometry)  # -> Area, flatten(Centroid)
line = Line(StartPoint=area_2.Centroid, EndPoint=area.Centroid)
construct_domain = ConstructDomain(DomainStart=Slider(0.04, range=0..1), DomainEnd=Slider(7, range=0..10))
construct_domain_2 = ConstructDomain(DomainStart=Slider(0.04, range=0..1), DomainEnd=Slider(20, range=0..20))
range = Range(Domain=construct_domain_2, Steps=multiplication)
range_2 = Range(Domain=construct_domain, Steps=multiplication)
geometry = Geometry(line)
geometry_2 = Geometry(flatten(rotate_3d.Geometry))
geometry_3 = Geometry(flatten(isotrim))
unit_z_2 = UnitZ(Factor=range)
unit_z_3 = UnitZ(Factor=range)
extrude = Extrude(Base=geometry_3, Direction=expr("-x", unit_z_3))
extrude_2 = Extrude(Base=geometry_2, Direction=unit_z_2)
pipe = Pipe(Curve=geometry, Radius=range_2, Caps=0)
