# Grasshopper definition Feb 4th 002.gh (Grasshopper 0.9.80)
# plug-ins: Bifocals

number_slider = Slider(0.52, range=0..2)
number_slider_2 = Slider(45, range=0..100)
number_slider_3 = Slider(17, range=0..100)
md_slider = MDSlider(
    slider_value=Point(0.5162905513, 0.453999217, 0.5),
    SliderMode=0,
    x_domain=Domain(0, 1),
    y_domain=Domain(0, 1),
    z_domain=Domain(0, 1))
plane_surface = PlaneSurface(Plane=PlaneXY(0, 0, 0), XSize=number_slider_2, YSize=number_slider_2)
md_slider_2 = MDSlider(slider_value=Point(1, 0, 0.5), SliderMode=0, x_domain=Domain(0, 1), y_domain=Domain(0, 1), z_domain=Domain(0, 1))
surface = Surface(plane_surface)
unit_z = UnitZ(Factor=number_slider_3)
unit_z_2 = UnitZ(Factor=number_slider_3)
curve = Curve(<curve referenced from the Rhino model>)
curve_2 = Curve(<curve referenced from the Rhino model>)
md_slider_3 = MDSlider(slider_value=Point(0, 1, 0.5), SliderMode=0, x_domain=Domain(0, 1), y_domain=Domain(0, 1), z_domain=Domain(0, 1))
iso_curve = IsoCurve(Surface=reparameterize(surface), UVPoint=[md_slider_2, md_slider, md_slider_3])  # -> UIsocurve, VIsocurve
divide_curve = DivideCurve(Curve=iso_curve.UIsocurve, Count=10, Kinks=False)  # -> Points, Tangents, Parameters
divide_curve_2 = DivideCurve(Curve=iso_curve.VIsocurve, Count=10, Kinks=False)  # -> Points, Tangents, Parameters
move = Move(Geometry=divide_curve.Points, Motion=unit_z_2)  # -> Geometry, Transform
move_2 = Move(Geometry=divide_curve_2.Points, Motion=expr("-x", unit_z))  # -> Geometry, Transform
interpolate = Interpolate(Vertices=move.Geometry, Degree=3, Periodic=False, KnotStyle=1)  # -> Curve, Length, Domain
interpolate_2 = Interpolate(Vertices=move_2.Geometry, Degree=3, Periodic=False, KnotStyle=1)  # -> Curve, Length, Domain
line = Line(StartPoint=move.Geometry, EndPoint=move_2.Geometry)
sphere = Sphere(Base=[move_2.Geometry, move.Geometry], Radius=expr("2*x", number_slider))
pipe = Pipe(Curve=[interpolate_2.Curve, line, interpolate.Curve], Radius=number_slider, Caps=0)
brep = Brep([pipe, sphere])
