# Grasshopper definition Feb 4th 003.gh (Grasshopper 0.9.80)
# plug-ins: Bifocals

polygon = Polygon(Plane=PlaneXY(0, 0, 0), Radius=Slider(26, range=0..100), Segments=Slider(6, range=0..10), FilletRadius=0)  # -> Polygon, Length
pi = Pi(Factor=Slider(2, range=0..2))
explode = Explode(Curve=polygon.Polygon, Recursive=True)  # -> Segments, Vertices
area = Area(Geometry=polygon.Polygon)  # -> Area, Centroid
unit_z = UnitZ(Factor=Slider(12, range=0..100))
point_on_curve = PointOnCurve(explode.Segments, parameter=0.5)
move = Move(Geometry=explode.Vertices, Motion=unit_z)  # -> Geometry, Transform
line = Line(StartPoint=point_on_curve, EndPoint=area.Centroid)
list_item = ListItem(List=point_on_curve, Index=0, Wrap=True)
list_item_2 = ListItem(List=point_on_curve, Index=Slider(1, range=0..1), Wrap=True)
line_2 = Line(StartPoint=list_item, EndPoint=list_item_2)
point_on_curve_2 = PointOnCurve(line, parameter=0.529)
perp_frame = PerpFrame(Curve=reparameterize(line_2), Parameter=Slider(0, range=0..1))
weave = Weave(Pattern=[0, 1], Stream0=move.Geometry, Stream1=point_on_curve_2, NullGaps=False)
polyline = PolyLine(Vertices=weave, Closed=False)
xy_plane = XYPlane(Origin=Point(0, 0, 0))
pipe = Pipe(Curve=polyline, Radius=Slider(0.93, range=0..3), Caps=0)
mirror = Mirror(Geometry=pipe, Plane=xy_plane)  # -> Geometry, Transform
brep = Brep([mirror.Geometry, pipe])
polar_array = PolarArray(Geometry=brep, Plane=perp_frame, Count=Slider(4, range=0..10), Angle=pi)  # -> Geometry, Transform
