# Grasshopper definition February 3rd.gh (Grasshopper 0.9.80)
# plug-ins: Bifocals

number_slider = Slider(4, range=0..10)
number_slider_2 = Slider(32, range=0..100)
number_slider_3 = Slider(3, range=0..3)
curve = Curve(<curve referenced from the Rhino model>)
divide_curve = DivideCurve(Curve=curve, Count=Slider(100, range=0..100), Kinks=False)  # -> Points, Tangents, Parameters
negative = Negative(Value=number_slider_2)
unit_z = UnitZ(Factor=number_slider_2)
unit_z_2 = UnitZ(Factor=negative)
evaluate_curve = EvaluateCurve(Curve=reparameterize(curve), Parameter=Slider(0.5, range=0..1))  # -> Point, Tangent, Angle
evaluate_curve_2 = EvaluateCurve(Curve=reparameterize(curve), Parameter=Slider(0, range=0..1))  # -> Point, Tangent, Angle
line = Line(StartPoint=evaluate_curve_2.Point, EndPoint=evaluate_curve.Point)
point_on_curve = PointOnCurve(line, parameter=0.5)
move = Move(Geometry=point_on_curve, Motion=unit_z)  # -> Geometry, Transform
move_2 = Move(Geometry=point_on_curve, Motion=unit_z_2)  # -> Geometry, Transform
multiplication = Multiplication(A=number_slider_3, B=Slider(2, range=1..2))
line_2 = Line(StartPoint=divide_curve.Points, EndPoint=move_2.Geometry)
line_3 = Line(StartPoint=divide_curve.Points, EndPoint=move.Geometry)
sphere = Sphere(Base=[divide_curve.Points, move_2.Geometry, move.Geometry], Radius=multiplication)
pipe = Pipe(Curve=[line_3, line_2], Radius=number_slider_3, Caps=0)
