# Grasshopper definition February 5th Toy.gh (Grasshopper 0.9.80)
# plug-ins: Bifocals

number_slider = Slider(7, range=3..13)
polygon = Polygon(Plane=PlaneXY(0, 0, 0), Radius=3, Segments=number_slider, FilletRadius=0)  # -> Polygon, Length
area = Area(Geometry=polygon.Polygon)  # -> Area, Centroid
md_slider = MDSlider(
    slider_value=Point(0.6437958508, 0.6535287252, 0.5),
    SliderMode=0,
    x_domain=Domain(0, 1),
    y_domain=Domain(0, 1),
    z_domain=Domain(0, 1))
explode = Explode(Curve=polygon.Polygon, Recursive=True)  # -> Segments, Vertices
point_on_curve = PointOnCurve(explode.Segments, parameter=1)
cull_index = CullIndex(List=explode.Vertices, Indices=Slider(0, range=0..100), Wrap=True)
horizontal_frames = HorizontalFrames(Curve=polygon.Polygon, Count=number_slider)  # -> Frames, Parameters
evaluate_surface = EvaluateSurface(Surface=reparameterize(horizontal_frames.Frames), Point=md_slider)  # -> Point, Normal, Frame
rectangle_2pt = Rectangle2Pt(Plane=PlaneXY(0, 0, 0), PointA=cull_index, PointB=point_on_curve, Radius=0)  # -> Rectangle, Length
area_2 = Area(Geometry=horizontal_frames.Frames)  # -> Area, Centroid
vector_2pt = Vector2Pt(PointA=area_2.Centroid, PointB=evaluate_surface.Point, Unitize=False)  # -> Vector, Length
line_sdl = LineSDL(Start=area_2.Centroid, Direction=vector_2pt.Vector, Length=Slider(3, range=0..100))
point_on_curve_2 = PointOnCurve(line_sdl, parameter=0)
shift_list = ShiftList(List=point_on_curve_2, Shift=1, Wrap=True)
panel = Panel(point_on_curve_2)
point_on_curve_3 = PointOnCurve(line_sdl, parameter=1)
panel_2 = Panel(shift_list)
line = Line(StartPoint=point_on_curve_3, EndPoint=shift_list)
line_2 = Line(StartPoint=area.Centroid, EndPoint=point_on_curve_3)
interpolate = Interpolate(Vertices=point_on_curve_3, Degree=3, Periodic=True, KnotStyle=1)  # -> Curve, Length, Domain
join_curves = JoinCurves(Curves=[line, interpolate.Curve, line_sdl], Preserve=False)
pipe = Pipe(Curve=join_curves, Radius=Slider(0.06, range=0..1), Caps=0)
