# Grasshopper definition February 7th 2.gh (Grasshopper 0.9.80)
# plug-ins: Bifocals

number_slider = Slider(12, range=0..100)
md_slider = MDSlider(
    slider_value=Point(0.3963414634, 0.3475609756, 0.5),
    SliderMode=0,
    x_domain=Domain(0, 1),
    y_domain=Domain(0, 1),
    z_domain=Domain(0, 1))
circle = Circle(Plane=PlaneXY(0, 0, 0), Radius=1)
boundary_surfaces = BoundarySurfaces(Edges=circle)  # -> reparameterize(Surfaces)
md_slider_2 = MDSlider(
    slider_value=Point(0.5182926829, 0.6890243902, 0.5),
    SliderMode=0,
    x_domain=Domain(0, 1),
    y_domain=Domain(0, 1),
    z_domain=Domain(0, 1))
number_slider_2 = Slider(0.6, range=0..1)
number_slider_3 = Slider(0.65, range=0..1)
graph_mapper = GraphMapper(x0=0, x1=1, y0=0, y1=1, container_name="Bezier", cpx=[0, 0.25, 0.75, 1], cpy=[0, 0.25, 0.75, 1])
divide_domain² = DivideDomain²(Domain=boundary_surfaces, UCount=number_slider, VCount=number_slider)
iso_curve = IsoCurve(Surface=boundary_surfaces, UVPoint=md_slider)  # -> UIsocurve, VIsocurve
evaluate_curve = EvaluateCurve(Curve=reparameterize(iso_curve.UIsocurve), Parameter=md_slider_2)  # -> Point, Tangent, Angle
evaluate_curve_2 = EvaluateCurve(Curve=reparameterize(iso_curve.VIsocurve), Parameter=md_slider_2)  # -> Point, Tangent, Angle
line = Line(StartPoint=evaluate_curve.Point, EndPoint=evaluate_curve_2.Point)
