# Grasshopper definition February 8thb.gh (Grasshopper 0.9.80)
# plug-ins: Bifocals

number_slider = Slider(23, range=0..100)
number_slider_2 = Slider(20, range=0..100)
number_slider_3 = Slider(0, range=0..1)
construct_domain = ConstructDomain(DomainStart=Slider(1, range=0..1), DomainEnd=Slider(12, range=0..100))
range = Range(Domain=number_slider, Steps=number_slider_2)
range_2 = Range(Domain=number_slider, Steps=number_slider_2)
rectangle = Rectangle(Plane=PlaneXY(0, 0, 0), XSize=range, YSize=range_2, Radius=Slider(1, range=0..100))  # -> Rectangle, Length
range_3 = Range(Domain=construct_domain, Steps=expr("x-1", number_slider_2))
cull_index = CullIndex(List=rectangle.Rectangle, Indices=number_slider_3, Wrap=True)
unit_z = UnitZ(Factor=range_3)
cull_index_2 = CullIndex(List=cull_index, Indices=number_slider_3, Wrap=True)  # -> graft(List)
construct_domain_2 = ConstructDomain(DomainStart=Slider(1, range=0..1), DomainEnd=Slider(48, range=0..100))
move = Move(Geometry=rectangle.Rectangle, Motion=unit_z)  # -> Geometry, Transform
range_4 = Range(Domain=construct_domain_2, Steps=expr("x-1", number_slider_2))
cull_index_3 = CullIndex(List=move.Geometry, Indices=number_slider_3, Wrap=True)
cull_index_4 = CullIndex(List=cull_index_3, Indices=number_slider_3, Wrap=True)  # -> graft(List)
unit_z_2 = UnitZ(Factor=range_4)
loft = Loft(
    Curves=[cull_index_2, cull_index_4],
    Options={Adjust=False, Closed=False, LoftEnds=0, LoftSimp=0, LoftType=2, Rebuild=10, Refit=0.01})  # -> flatten(Loft)
move_2 = Move(Geometry=loft, Motion=unit_z_2)  # -> Geometry, Transform
