# Grasshopper definition February 9th.gh (Grasshopper 0.9.80)
# plug-ins: Bifocals

rotprepframes2 = Slider(0.75, range=0..2)
rotprepframes3 = Slider(0.78, range=0..2)
lentoptierlines = Slider(46, range=0..100)
heightcentroide = Slider(54, range=0..100)
# PLAY
radiusbasecir = Slider(13, range=0..100)
dividecrv = Slider(10, range=0..10)
lenmidlines = Slider(30, range=0..100)
radtoptiercir = Slider(14, range=0..100)
lenbaselines = Slider(11, range=0..100)
lentoplines = Slider(78, range=0..100)
rotbasecir = Slider(0.36, range=0..1)
rotperpframes = Slider(0.68, range=0..2)

circle = Circle(Plane=PlaneXY(0, 0, 0), Radius=radiusbasecir)
divide_curve = DivideCurve(Curve=circle, Count=dividecrv, Kinks=False)  # -> Points, Tangents, Parameters
perp_frames = PerpFrames(Curve=circle, Count=10, Align=True)  # -> Frames, Parameters
pi = Pi(Factor=rotperpframes)
rotate_plane = RotatePlane(Plane=perp_frames.Frames, Angle=pi)
deconstruct_plane = DeconstructPlane(Plane=rotate_plane)  # -> Origin, XAxis, YAxis, ZAxis
line_sdl = LineSDL(Start=deconstruct_plane.Origin, Direction=deconstruct_plane.XAxis, Length=lenbaselines)
area = Area(Geometry=circle)  # -> Area, Centroid
area_2 = Area(Geometry=circle)  # -> Area, Centroid
unit_z = UnitZ(Factor=heightcentroide)
end_points = EndPoints(Curve=line_sdl)  # -> Start, End
interpolate = Interpolate(Vertices=end_points.End, Degree=3, Periodic=False, KnotStyle=1)  # -> Curve, Length, Domain
line = Line(StartPoint=end_points.End, EndPoint=area.Centroid)
move = Move(Geometry=area_2.Centroid, Motion=unit_z)  # -> Geometry, Transform
perp_frames_2 = PerpFrames(Curve=interpolate.Curve, Count=10, Align=True)  # -> Frames, Parameters
pi_2 = Pi(Factor=rotprepframes2)
line_2 = Line(StartPoint=end_points.End, EndPoint=move.Geometry)
rotate_plane_2 = RotatePlane(Plane=perp_frames_2.Frames, Angle=pi_2)
deconstruct_plane_2 = DeconstructPlane(Plane=rotate_plane_2)  # -> Origin, XAxis, YAxis, ZAxis
line_sdl_2 = LineSDL(Start=deconstruct_plane_2.Origin, Direction=deconstruct_plane_2.XAxis, Length=lenmidlines)
end_points_2 = EndPoints(Curve=line_sdl_2)  # -> Start, End
interpolate_2 = Interpolate(Vertices=end_points_2.End, Degree=3, Periodic=False, KnotStyle=1)  # -> Curve, Length, Domain
perp_frames_3 = PerpFrames(Curve=interpolate_2.Curve, Count=10, Align=True)  # -> Frames, Parameters
pi_3 = Pi(Factor=rotprepframes3)
rotate_plane_3 = RotatePlane(Plane=perp_frames_3.Frames, Angle=pi_3)
deconstruct_plane_3 = DeconstructPlane(Plane=rotate_plane_3)  # -> Origin, XAxis, YAxis, ZAxis
line_sdl_3 = LineSDL(Start=deconstruct_plane_3.Origin, Direction=deconstruct_plane_3.XAxis, Length=lentoplines)
end_points_3 = EndPoints(Curve=line_sdl_3)  # -> Start, End
polyline = PolyLine(Vertices=end_points_3.End, Closed=True)
explode = Explode(Curve=polyline, Recursive=True)  # -> Segments, Vertices
dispatch = Dispatch(List=explode.Segments, DispatchPattern=[True, False])  # -> ListA, ListB
unit_z_2 = UnitZ(Factor=lentoptierlines)
curve = Curve(dispatch.ListA)
curve_2 = Curve(dispatch.ListB)
unit_z_3 = UnitZ(Factor=1)
pi_4 = Pi(Factor=rotbasecir)
end_points_4 = EndPoints(Curve=curve)  # -> Start, End
end_points_5 = EndPoints(Curve=curve_2)  # -> Start, End

# ----
# Bake This!
pipe = Pipe(Curve=line, Radius=1, Caps=0)
pipe_2 = Pipe(Curve=line_2, Radius=1, Caps=0)
loft = Loft(Curves=line_sdl_2, Options={Adjust=False, Closed=True, LoftEnds=0, LoftSimp=0, LoftType=0, Rebuild=10, Refit=0.01})
pipe_3 = Pipe(Curve=line_sdl_3, Radius=1, Caps=0)
boundary_surfaces = BoundarySurfaces(Edges=polyline)

area_3 = Area(Geometry=boundary_surfaces)  # -> Area, Centroid
line_3 = Line(StartPoint=area_3.Centroid, EndPoint=move.Geometry)
move_2 = Move(Geometry=area_3.Centroid, Motion=unit_z_2)  # -> Geometry, Transform
circle_cnr = CircleCNR(Center=move_2.Geometry, Normal=Vector(0, 0, 1), Radius=radtoptiercir)
rotate_3d = Rotate3D(Geometry=circle_cnr, Angle=pi_4, Center=area_3.Centroid, Axis=unit_z_3)  # -> Geometry, Transform
divide_curve_2 = DivideCurve(Curve=rotate_3d.Geometry, Count=dividecrv, Kinks=False)  # -> Points, Tangents, Parameters

pipe_4 = Pipe(Curve=line_3, Radius=line_3, Caps=2)
boundary_surfaces_2 = BoundarySurfaces(Edges=circle_cnr)
_4point_surface = _4PointSurface(CornerA=divide_curve_2.Points, CornerB=end_points_4.Start, CornerC=end_points_5.Start)
