# Grasshopper definition February10thAnimation.gh (Grasshopper 0.9.80)
# plug-ins: Bifocals

geometry = Geometry(<brep referenced from the Rhino model>)
populate_geometry = PopulateGeometry(Geometry=geometry, Count=Slider(34, range=0..100), Seed=Slider(12, range=0..100))
voronoi_3d = Voronoi3D(Points=populate_geometry, Box=geometry)  # -> graft(Cells), Boundary
solid_intersection = SolidIntersection(BrepsA=geometry, BrepsB=voronoi_3d.Cells)  # -> flatten(Result)
deconstruct_brep = DeconstructBrep(Brep=solid_intersection)  # -> Faces, Edges, Vertices
md_slider = MDSlider(slider_value=Point(0.5, 0.5, 0.5), SliderMode=0, x_domain=Domain(0, 1), y_domain=Domain(0, 1), z_domain=Domain(0, 1))
list_item = ListItem(List=deconstruct_brep.Faces, Index=0, Wrap=True)
list_item_2 = ListItem(List=deconstruct_brep.Faces, Index=Slider(4, range=0..10), Wrap=True)
list_item_3 = ListItem(List=deconstruct_brep.Faces, Index=Slider(6, range=0..10), Wrap=True)
list_item_4 = ListItem(List=deconstruct_brep.Faces, Index=Slider(3, range=0..10), Wrap=True)
list_item_5 = ListItem(List=deconstruct_brep.Faces, Index=Slider(5, range=0..10), Wrap=True)
list_item_6 = ListItem(List=deconstruct_brep.Faces, Index=Slider(2, range=0..10), Wrap=True)
list_item_7 = ListItem(List=deconstruct_brep.Faces, Index=Slider(1, range=0..1), Wrap=True)
list_item_8 = ListItem(List=deconstruct_brep.Faces, Index=Slider(7, range=0..10), Wrap=True)
list_item_9 = ListItem(List=deconstruct_brep.Faces, Index=Slider(8, range=0..10), Wrap=True)
list_item_10 = ListItem(List=deconstruct_brep.Faces, Index=Slider(9, range=0..10), Wrap=True)
list_item_11 = ListItem(List=deconstruct_brep.Faces, Index=Slider(10, range=0..10), Wrap=True)
evaluate_surface = EvaluateSurface(Surface=list_item, Point=md_slider)  # -> Point, Normal, Frame
multiplication = Multiplication(A=evaluate_surface.Normal, B=Slider(10, range=0..100))

move = Move(Geometry=list_item, Motion=multiplication)  # -> Geometry, Transform
move_2 = Move(Geometry=list_item_7, Motion=multiplication)  # -> Geometry, Transform
move_3 = Move(Geometry=list_item_6, Motion=multiplication)  # -> Geometry, Transform
move_4 = Move(Geometry=list_item_4, Motion=multiplication)  # -> Geometry, Transform
move_5 = Move(Geometry=list_item_2, Motion=multiplication)  # -> Geometry, Transform
move_6 = Move(Geometry=list_item_5, Motion=multiplication)  # -> Geometry, Transform
move_7 = Move(Geometry=list_item_3, Motion=multiplication)  # -> Geometry, Transform
move_8 = Move(Geometry=list_item_8, Motion=multiplication)  # -> Geometry, Transform
move_9 = Move(Geometry=list_item_9, Motion=multiplication)  # -> Geometry, Transform
move_10 = Move(Geometry=list_item_10, Motion=multiplication)  # -> Geometry, Transform
move_11 = Move(Geometry=list_item_11, Motion=multiplication)  # -> Geometry, Transform
