# Grasshopper definition February10thBREAKTHROUGH2.0.gh (Grasshopper 0.9.80)
# plug-ins: Bifocals

md_slider = MDSlider(slider_value=Point(1, 0.5, 0.5), SliderMode=0, x_domain=Domain(0, 1), y_domain=Domain(0, 1), z_domain=Domain(0, 1))
md_slider_2 = MDSlider(
    slider_value=Point(0, 0.4756097561, 0.5),
    SliderMode=0,
    x_domain=Domain(0, 1),
    y_domain=Domain(0, 1),
    z_domain=Domain(0, 1))
number_slider = Slider(0.51, range=0.1..2)
number_slider_2 = Slider(0.36, range=0..2)

# ----
# Create a cool closed curve in Rhino for Wheel rail
geometry = Geometry(<curve referenced from the Rhino model>)

construct_point = ConstructPoint(XCoordinate=0, YCoordinate=0, ZCoordinate=Slider(4, range=0..10))
number_slider_3 = Slider(10, range=0..10)
unit_z = UnitZ(Factor=Slider(8, range=0..100))
plane_normal = PlaneNormal(Origin=construct_point, ZAxis=Vector(0, 0, 1))
negative = Negative(Value=unit_z)
rectangle = Rectangle(Plane=plane_normal, XSize=Slider(9, range=0..100), YSize=Slider(6, range=0..100), Radius=0)  # -> Rectangle, Length
area = Area(Geometry=rectangle.Rectangle)  # -> Area, Centroid
explode = Explode(Curve=rectangle.Rectangle, Recursive=True)  # -> Segments, Vertices
point_on_curve = PointOnCurve(explode.Segments, parameter=1)
explode_2 = Explode(Curve=rectangle.Rectangle, Recursive=True)  # -> Segments, Vertices
unit_z_2 = UnitZ(Factor=Slider(82, range=0..100))
pi = Pi(Factor=Slider(1.64, range=0..2))
move = Move(Geometry=explode_2.Vertices, Motion=negative)  # -> Geometry, Transform
perp_frames = PerpFrames(Curve=explode.Segments, Count=Slider(1, range=0..1), Align=True)  # -> Frames, Parameters
move_2 = Move(Geometry=point_on_curve, Motion=unit_z_2)  # -> Geometry, Transform
rotate_plane = RotatePlane(Plane=perp_frames.Frames, Angle=pi)
deconstruct_plane = DeconstructPlane(Plane=rotate_plane)  # -> Origin, XAxis, YAxis, ZAxis
polyline = PolyLine(Vertices=move_2.Geometry, Closed=True)
polyline_2 = PolyLine(Vertices=move.Geometry, Closed=False)
line_sdl = LineSDL(Start=deconstruct_plane.Origin, Direction=deconstruct_plane.XAxis, Length=Slider(57, range=0..100))
line = Line(StartPoint=deconstruct_plane.Origin, EndPoint=move_2.Geometry)
explode_3 = Explode(Curve=polyline_2, Recursive=True)  # -> Segments, Vertices
end_points = EndPoints(Curve=line_sdl)  # -> Start, End
line_2 = Line(StartPoint=end_points.End, EndPoint=move_2.Geometry)
unit_z_3 = UnitZ(Factor=Slider(10, range=0..100))
scale = Scale(Geometry=explode_3.Vertices, Center=area.Centroid, Factor=Slider(5, range=0..10))  # -> Geometry, Transform
unit_z_4 = UnitZ(Factor=1)
negative_2 = Negative(Value=unit_z_3)
line_3 = Line(StartPoint=explode_2.Vertices, EndPoint=scale.Geometry)
polyline_3 = PolyLine(Vertices=scale.Geometry, Closed=False)
patch = Patch(Curves=polyline_3, Spans=20, Flexibility=1, Trim=True)
patch_2 = Patch(Curves=explode_2.Segments, Spans=20, Flexibility=1, Trim=True)

extrude = Extrude(Base=patch, Direction=negative_2)
extrude_2 = Extrude(Base=patch_2, Direction=unit_z_4)

deconstruct_brep = DeconstructBrep(Brep=extrude)  # -> Faces, Edges, Vertices
list_item = ListItem(List=deconstruct_brep.Faces, Index=Slider(2, range=0..6), Wrap=True)
evaluate_surface = EvaluateSurface(Surface=list_item, Point=[md_slider, md_slider_2])  # -> Point, Normal, Frame
unit_x = UnitX(Factor=1)
unit_y = UnitY(Factor=1)
circle_cnr = CircleCNR(Center=evaluate_surface.Point, Normal=unit_x, Radius=Slider(20, range=0..30))
pi_2 = Pi(Factor=Slider(4.05, range=0..5))
rotate_3d = Rotate3D(Geometry=circle_cnr, Angle=expr("-x", pi_2), Center=evaluate_surface.Point, Axis=unit_y)  # -> Geometry, Transform
rotate_3d_2 = Rotate3D(Geometry=circle_cnr, Angle=pi_2, Center=evaluate_surface.Point, Axis=unit_y)  # -> Geometry, Transform
unit_z_5 = UnitZ(Factor=1)
dispatch = Dispatch(List=rotate_3d_2.Geometry, DispatchPattern=[True, False])  # -> ListA, ListB
dispatch_2 = Dispatch(List=rotate_3d.Geometry, DispatchPattern=[True, False])  # -> ListA, ListB
extrude_3 = Extrude(Base=geometry, Direction=unit_z_5)
area_2 = Area(Geometry=dispatch_2.ListB)  # -> Area, Centroid
area_3 = Area(Geometry=dispatch.ListA)  # -> Area, Centroid
geometry_2 = Geometry(dispatch_2.ListA)
geometry_3 = Geometry(dispatch.ListB)
cap_holes = CapHoles(Brep=extrude_3)
deconstruct_brep_2 = DeconstructBrep(Brep=cap_holes)  # -> Faces, Edges, Vertices
list_item_2 = ListItem(List=deconstruct_brep_2.Faces, Index=0, Wrap=True)
list_item_3 = ListItem(List=deconstruct_brep_2.Faces, Index=Slider(1, range=0..1), Wrap=True)
line_4 = Line(StartPoint=area_3.Centroid, EndPoint=area_2.Centroid)
area_4 = Area(Geometry=list_item_2)  # -> Area, Centroid
area_5 = Area(Geometry=list_item_3)  # -> Area, Centroid
line_5 = Line(StartPoint=area_4.Centroid, EndPoint=area_5.Centroid)
divide_curve = DivideCurve(Curve=geometry_3, Count=number_slider_3, Kinks=False)  # -> Points, Tangents, Parameters
divide_curve_2 = DivideCurve(Curve=geometry_2, Count=number_slider_3, Kinks=False)  # -> Points, Tangents, Parameters
line_6 = Line(StartPoint=divide_curve.Points, EndPoint=area_2.Centroid)
line_7 = Line(StartPoint=divide_curve_2.Points, EndPoint=area_3.Centroid)

flow = Flow(Geometry=cap_holes, Base=line_5, Target=geometry_3, ReverseBase=False, ReverseTarget=False, Stretch=True)
flow_2 = Flow(Geometry=cap_holes, Base=line_5, Target=geometry_2, ReverseBase=False, ReverseTarget=False, Stretch=True)

pipe = Pipe(Curve=line_3, Radius=expr("2*x", number_slider), Caps=0)
pipe_2 = Pipe(Curve=[line_7, line_6], Radius=number_slider, Caps=0)
pipe_3 = Pipe(Curve=line_2, Radius=number_slider, Caps=0)
pipe_4 = Pipe(Curve=line, Radius=number_slider, Caps=0)
pipe_5 = Pipe(Curve=line_4, Radius=Slider(10, range=0..10), Caps=0)
