# Grasshopper definition February10thBells.gh (Grasshopper 0.9.80)
# plug-ins: Bifocals

circle_cnr = CircleCNR(Center=Point(0, 0, 0), Normal=Vector(0, 0, 1), Radius=Slider(27, range=0..100))
construct_domain = ConstructDomain(DomainStart=0, DomainEnd=Slider(42, range=0..100))
curve = Curve(reparameterize(circle_cnr))
range = Range(Domain=construct_domain, Steps=10)
unit_z = UnitZ(Factor=range)
move = Move(Geometry=curve, Motion=unit_z)  # -> Geometry, Transform
list_length = ListLength(List=move.Geometry)
split_list = SplitList(List=move.Geometry, Index=expr("x/2", list_length))  # -> ListA, ListB
area = Area(Geometry=split_list.ListA)  # -> Area, Centroid
area_2 = Area(Geometry=split_list.ListB)  # -> Area, Centroid
curve_closest_point = CurveClosestPoint(Point=area_2.Centroid, Curve=curve)  # -> Point, Parameter, Distance
curve_closest_point_2 = CurveClosestPoint(Point=area.Centroid, Curve=curve)  # -> Point, Parameter, Distance
distance = Distance(PointA=area.Centroid, PointB=curve_closest_point_2.Point)
distance_2 = Distance(PointA=area_2.Centroid, PointB=curve_closest_point.Point)
bounds = Bounds(Numbers=distance_2)
bounds_2 = Bounds(Numbers=distance)
construct_domain_2 = ConstructDomain(DomainStart=Slider(0.91, range=0..1), DomainEnd=Slider(0.17, range=-1..1))
graph_mapper = GraphMapper(
    construct_domain_2,
    x0=0,
    x1=1,
    y0=0,
    y1=1,
    container_name="Parabola",
    Ox=0.4133858383,
    Oy=0,
    Px=0.807086587,
    Py=0.1841155291)
construct_domain_3 = ConstructDomain(DomainStart=Slider(0.91, range=0..1), DomainEnd=Slider(0.17, range=-1..1))
graph_mapper_2 = GraphMapper(
    construct_domain_3,
    x0=0,
    x1=1,
    y0=0,
    y1=1,
    container_name="Sine",
    Equation_px=[0.08474576473, 0.2338983119],
    Equation_py=[0.003174602985, 0.6285713911])
remap_numbers = RemapNumbers(Value=distance_2, Source=bounds, Target=graph_mapper)  # -> Mapped, Clipped
remap_numbers_2 = RemapNumbers(Value=distance, Source=bounds_2, Target=graph_mapper_2)  # -> Mapped, Clipped
scale = Scale(Geometry=split_list.ListA, Center=area.Centroid, Factor=remap_numbers_2.Mapped)  # -> Geometry, Transform
scale_2 = Scale(Geometry=split_list.ListB, Center=area.Centroid, Factor=remap_numbers.Mapped)  # -> Geometry, Transform
unit_z_2 = UnitZ(Factor=Slider(14, range=0..100))
move_2 = Move(Geometry=scale_2.Geometry, Motion=unit_z_2)  # -> Geometry, Transform
loft = Loft(
    Curves=[scale.Geometry, move_2.Geometry],
    Options={Adjust=False, Closed=False, LoftEnds=0, LoftSimp=0, LoftType=0, Rebuild=10, Refit=0.01})
reverse_list = ReverseList(List=move_2.Geometry)
surface = Surface(loft)
offset = Offset(Surface=surface, Distance=expr("-x", Slider(1, range=0..1)), Retrim=True)
list_item = ListItem(List=reverse_list, Index=Slider(0, range=0..100), Wrap=True)
brep = Brep(loft)
brep_2 = Brep(offset)
deconstruct_brep = DeconstructBrep(Brep=brep_2)  # -> Faces, Edges, Vertices
deconstruct_brep_2 = DeconstructBrep(Brep=brep)  # -> Faces, Edges, Vertices
number_slider = Slider(2, range=0..10)
number_slider_2 = Slider(1, range=0..10)
list_item_2 = ListItem(List=deconstruct_brep_2.Edges, Index=number_slider, Wrap=True)
list_item_3 = ListItem(List=deconstruct_brep_2.Edges, Index=number_slider_2, Wrap=True)
list_item_4 = ListItem(List=deconstruct_brep.Edges, Index=number_slider, Wrap=True)
list_item_5 = ListItem(List=deconstruct_brep.Edges, Index=number_slider_2, Wrap=True)

boundary_surfaces = BoundarySurfaces(Edges=list_item)
loft_2 = Loft(
    Curves=[list_item_4, list_item_2],
    Options={Adjust=False, Closed=False, LoftEnds=0, LoftSimp=0, LoftType=0, Rebuild=10, Refit=0.01})
loft_3 = Loft(
    Curves=[list_item_5, list_item_3],
    Options={Adjust=False, Closed=False, LoftEnds=0, LoftSimp=0, LoftType=0, Rebuild=10, Refit=0.01})
brep_3 = Brep(brep)
brep_4 = Brep(brep_2)
