# Grasshopper definition February24th003.gh (Grasshopper 1.0.7)
# plug-ins: Bifocals

md_slider = MDSlider(
    SliderMode=0,
    slider_value=Point(0.452940592, 0.2833352438, 0.5),
    x_domain=Domain(0, 1),
    y_domain=Domain(0, 1),
    z_domain=Domain(0, 1))
number_slider = Slider(9, range=0..10)
md_slider_2 = MDSlider(SliderMode=0, slider_value=Point(0, 0, 0.5), x_domain=Domain(0, 1), y_domain=Domain(0, 1), z_domain=Domain(0, 1))
unit_z = UnitZ(Factor=1)
line_sdl = LineSDL(Start=Point(0, 0, 0), Direction=unit_z, Length=Slider(42, range=0..100))
sequence = Sequence(Notation="[N-1] + [N-2]", Length=expr("x+1", number_slider), Initial=[1, 1])
md_slider_3 = MDSlider(SliderMode=0, slider_value=Point(0, 1, 0.5), x_domain=Domain(0, 1), y_domain=Domain(0, 1), z_domain=Domain(0, 1))
md_slider_4 = MDSlider(SliderMode=0, slider_value=Point(1, 1, 0.5), x_domain=Domain(0, 1), y_domain=Domain(0, 1), z_domain=Domain(0, 1))
divide_curve = DivideCurve(Curve=line_sdl, Count=number_slider, Kinks=False)  # -> Points, Tangents, Parameters
unit_x = UnitX(Factor=sequence)
move = Move(Geometry=divide_curve.Points, Motion=expr("-x", unit_x))  # -> Geometry, Transform
move_2 = Move(Geometry=divide_curve.Points, Motion=unit_x)  # -> Geometry, Transform
perp_frame = PerpFrame(Curve=line_sdl, Parameter=Slider(1, range=0..1))
interpolate = Interpolate(Vertices=move_2.Geometry, Degree=3, Periodic=False, KnotStyle=1)  # -> Curve, Length, Domain
interpolate_2 = Interpolate(Vertices=move.Geometry, Degree=3, Periodic=False, KnotStyle=1)  # -> Curve, Length, Domain
loft = Loft(
    Curves=[interpolate.Curve, interpolate_2.Curve],
    Options={Adjust=False, Closed=False, LoftEnds=0, LoftSimp=0, LoftType=0, Rebuild=10, Refit=0.01})
mirror = Mirror(Geometry=loft, Plane=perp_frame)  # -> Geometry, Transform
evaluate_surface = EvaluateSurface(Surface=reparameterize(mirror.Geometry), Point=md_slider_2)  # -> Point, Normal, UDirection, VDirection, Frame
evaluate_surface_2 = EvaluateSurface(Surface=reparameterize(mirror.Geometry), Point=md_slider)  # -> Point, Normal, UDirection, VDirection, Frame
surface = Surface([loft, mirror.Geometry])
unit_y = UnitY(Factor=Slider(26, range=0..100))
move_3 = Move(Geometry=evaluate_surface_2.Point, Motion=unit_y)  # -> Geometry, Transform
arc_3pt = Arc3Pt(PointA=Point(0, 0, 0), PointB=move_3.Geometry, PointC=evaluate_surface.Point)  # -> Arc, Plane, Radius
bend_deform = BendDeform(Geometry=surface, BendingArc=arc_3pt.Arc)
evaluate_surface_3 = EvaluateSurface(Surface=reparameterize(bend_deform), Point=md_slider_3)  # -> Point, Normal, UDirection, VDirection, Frame
evaluate_surface_4 = EvaluateSurface(Surface=reparameterize(surface), Point=md_slider_4)  # -> Point, Normal, UDirection, VDirection, Frame
evaluate_surface_5 = EvaluateSurface(Surface=reparameterize(bend_deform), Point=md_slider_4)  # -> Point, Normal, UDirection, VDirection, Frame
evaluate_surface_6 = EvaluateSurface(Surface=reparameterize(surface), Point=md_slider_3)  # -> Point, Normal, UDirection, VDirection, Frame
line = Line(StartPoint=evaluate_surface_4.Point, EndPoint=evaluate_surface_5.Point)
line_2 = Line(StartPoint=evaluate_surface_6.Point, EndPoint=evaluate_surface_3.Point)
dispatch = Dispatch(List=line, DispatchPattern=[True, False])  # -> ListA, ListB
dispatch_2 = Dispatch(List=line_2, DispatchPattern=[True, False])  # -> ListA, ListB
construct_domain = ConstructDomain(DomainStart=Slider(0.01, range=0.01..1), DomainEnd=Slider(81, range=0..100))
loft_2 = Loft(
    Curves=[dispatch_2.ListA, dispatch.ListA],
    Options={Adjust=False, Closed=False, LoftEnds=0, LoftSimp=0, LoftType=0, Rebuild=10, Refit=0.01})
range = Range(Domain=construct_domain, Steps=Slider(10, range=0..10))
offset_surface = OffsetSurface(Surface=bend_deform, Distance=expr("-x", range), Retrim=True)
extrude = Extrude(Base=offset_surface, Direction=expr("x*5", evaluate_surface_3.Normal))
