# Grasshopper definition February8thc.gh (Grasshopper 0.9.80)
# plug-ins: Bifocals

number_slider = Slider(8, range=0..10)
number_slider_2 = Slider(12, range=0..20)
polygon = Polygon(Plane=PlaneXY(0, 0, 0), Radius=Slider(7, range=0..100), Segments=number_slider, FilletRadius=0)  # -> reparameterize(Polygon), Length
area = Area(Geometry=polygon.Polygon)  # -> Area, Centroid
divide_curve = DivideCurve(Curve=polygon.Polygon, Count=number_slider, Kinks=False)  # -> Points, Tangents, Parameters
explode = Explode(Curve=polygon.Polygon, Recursive=True)  # -> Segments, Vertices
line = Line(StartPoint=area.Centroid, EndPoint=divide_curve.Points)
number_slider_3 = Slider(2, range=0..10)
point_on_curve = PointOnCurve(explode.Segments, parameter=0.5)
point_on_curve_2 = PointOnCurve(line, parameter=0.314)
weave = Weave(Pattern=[0, 1], Stream0=point_on_curve_2, Stream1=point_on_curve, NullGaps=False)
polyline = PolyLine(Vertices=weave, Closed=True)
unit_x = UnitX(Factor=number_slider_2)
linear_array = LinearArray(Geometry=polyline, Direction=unit_x, Count=number_slider_3)  # -> Geometry, Transform
unit_y = UnitY(Factor=number_slider_2)
linear_array_2 = LinearArray(Geometry=linear_array.Geometry, Direction=unit_y, Count=number_slider_3)  # -> graft(Geometry), Transform
unit_z = UnitZ(Factor=1)
join_curves = JoinCurves(Curves=linear_array_2.Geometry, Preserve=False)  # -> graft(Curves)
list_item = ListItem(List=join_curves, Index=Slider(1, range=0..1), Wrap=True)  # -> flatten(Item)
extrude = Extrude(Base=list_item, Direction=unit_z)
cap_holes = CapHoles(Brep=extrude)
