# Grasshopper definition GenePoolCurvesPiped copy.gh (Grasshopper 0.9.80)

curve = Curve(<curve referenced from the Rhino model>)
curve_2 = Curve(<curve referenced from the Rhino model>)

number_slider = Slider(2.7, range=0..10)
number_slider_2 = Slider(0.61, range=0.2..1.5)
number_slider_3 = Slider(20, range=0..100)
number_slider_4 = Slider(0.55, range=0.1..1.55)
gene_pool = GenePool(Decimals=2, Maximum=2, Minimum=0, Value=[0, 0.47, 1.71, 0.32, 2, 1.08, 0.46, 0.4])
gene_pool_2 = GenePool(Decimals=2, Maximum=2, Minimum=0, Value=[0.3, 0.47, 0.76, 1.04, 1.2, 1.5, 1.53, 1.31])

gene_pool_3 = GenePool(Decimals=2, Maximum=1, Minimum=0, Value=[0, 0, 1, 1, 0, 0, 0, 1, 0, 1])
curve_3 = Curve(reparameterize(<curve referenced from the Rhino model>))
gene_pool_4 = GenePool(Decimals=2, Maximum=1, Minimum=0, Value=[1, 0, 1, 1, 0, 1, 0, 0, 0, 1])
series = Series(Start=Slider(0.001, range=0..0.001), Step=Slider(0.1, range=0.1..12), Count=Slider(14, range=0..100))
series_2 = Series(Start=Slider(0.001, range=0..0.001), Step=Slider(1.4, range=0.1..12), Count=10)
scale = Scale(Geometry=curve_3, Center=Point(0, 0, 0), Factor=series)  # -> graft(Geometry), Transform
list_length = ListLength(List=gene_pool)
list_length_2 = ListLength(List=gene_pool_2)
multiplication = Multiplication(A=number_slider, B=list_length)
multiplication_2 = Multiplication(A=number_slider, B=list_length_2)
unit_z = UnitZ(Factor=series_2)
perp_frames = PerpFrames(Curve=curve_2, Count=multiplication_2, Align=True)  # -> Frames, Parameters
repeat_data = RepeatData(Data=gene_pool_2, Length=expr("x+1", multiplication_2))
perp_frames_2 = PerpFrames(Curve=curve, Count=multiplication, Align=True)  # -> Frames, Parameters
repeat_data_2 = RepeatData(Data=gene_pool, Length=expr("x+1", multiplication))
move = Move(Geometry=flatten(scale.Geometry), Motion=reverse(unit_z))  # -> Geometry, Transform
deconstruct_plane = DeconstructPlane(Plane=perp_frames_2.Frames)  # -> Origin, XAxis, YAxis, ZAxis
deconstruct_plane_2 = DeconstructPlane(Plane=perp_frames.Frames)  # -> Origin, XAxis, YAxis, ZAxis
multiplication_3 = Multiplication(A=deconstruct_plane.XAxis, B=repeat_data_2)
multiplication_4 = Multiplication(A=deconstruct_plane.YAxis, B=repeat_data_2)
multiplication_5 = Multiplication(A=deconstruct_plane.ZAxis, B=repeat_data_2)
multiplication_6 = Multiplication(A=deconstruct_plane_2.XAxis, B=repeat_data)
multiplication_7 = Multiplication(A=deconstruct_plane_2.YAxis, B=repeat_data)
multiplication_8 = Multiplication(A=deconstruct_plane_2.ZAxis, B=repeat_data)
addition = Addition(A=multiplication_3, B=multiplication_4)
addition_2 = Addition(A=multiplication_6, B=multiplication_7)
addition_3 = Addition(A=addition, B=multiplication_5)
move_2 = Move(Geometry=deconstruct_plane.Origin, Motion=addition_3)  # -> Geometry, Transform
addition_4 = Addition(A=addition_2, B=multiplication_8)
move_3 = Move(Geometry=deconstruct_plane_2.Origin, Motion=addition_4)  # -> Geometry, Transform
interpolate = Interpolate(Vertices=move_2.Geometry, Degree=3, Periodic=False, KnotStyle=1)  # -> Curve, Length, Domain
interpolate_2 = Interpolate(Vertices=move_3.Geometry, Degree=3, Periodic=False, KnotStyle=1)  # -> Curve, Length, Domain
line = Line(StartPoint=move_2.Geometry, EndPoint=move_3.Geometry)
dispatch = Dispatch(List=move_2.Geometry, DispatchPattern=gene_pool_3)  # -> ListA, ListB
dispatch_2 = Dispatch(List=move_3.Geometry, DispatchPattern=gene_pool_4)  # -> ListA, ListB
point = Point(dispatch.ListA)
point_2 = Point(dispatch_2.ListA)
unit_z_2 = UnitZ(Factor=number_slider_3)
unit_z_3 = UnitZ(Factor=number_slider_3)
circle_cnr = CircleCNR(Center=point, Normal=Vector(0, 0, 1), Radius=number_slider_4)
circle_cnr_2 = CircleCNR(Center=point_2, Normal=Vector(0, 0, 1), Radius=number_slider_4)

extrude = Extrude(Base=circle_cnr, Direction=expr("-x", unit_z_2))
extrude_2 = Extrude(Base=circle_cnr_2, Direction=expr("-x", unit_z_3))
pipe = Pipe(Curve=interpolate_2.Curve, Radius=number_slider_2, Caps=1)
pipe_2 = Pipe(Curve=interpolate.Curve, Radius=number_slider_2, Caps=1)
pipe_3 = Pipe(Curve=line, Radius=number_slider_2, Caps=0)

unit_z_4 = UnitZ(Factor=Slider(12, range=1..12))
brep_join = BrepJoin(Breps=[pipe_2, pipe, extrude_2, pipe_3, extrude])  # -> Breps, Closed
move_4 = Move(Geometry=brep_join.Breps, Motion=unit_z_4)  # -> Geometry, Transform

loft = Loft(Curves=move.Geometry, Options={Adjust=False, Closed=False, LoftEnds=0, LoftSimp=0, LoftType=0, Rebuild=10, Refit=0.01})
brep = Brep(move_4.Geometry)
