# Grasshopper definition GenePoolCurvesPiped.gh (Grasshopper 0.9.80)

construct_point = ConstructPoint(XCoordinate=Slider(24, range=0..100), YCoordinate=0, ZCoordinate=0)
gene_pool = GenePool(Decimals=2, Maximum=2, Minimum=0, Value=[0, 1.12, 1.21, 1.54, 1.71, 1.73, 1.83, 2])
line = Line(StartPoint=Point(0, 0, 0), EndPoint=construct_point)
curve = Curve(<curve referenced from the Rhino model>)
list_length = ListLength(List=gene_pool)
multiplication = Multiplication(A=Slider(3, range=0..10), B=list_length)
perp_frames = PerpFrames(Curve=curve, Count=multiplication, Align=True)  # -> Frames, Parameters
repeat_data = RepeatData(Data=gene_pool, Length=expr("x+1", multiplication))
deconstruct_plane = DeconstructPlane(Plane=perp_frames.Frames)  # -> Origin, XAxis, YAxis, ZAxis
multiplication_2 = Multiplication(A=deconstruct_plane.XAxis, B=repeat_data)
multiplication_3 = Multiplication(A=deconstruct_plane.YAxis, B=repeat_data)
multiplication_4 = Multiplication(A=deconstruct_plane.ZAxis, B=repeat_data)
addition = Addition(A=multiplication_2, B=multiplication_3)
addition_2 = Addition(A=addition, B=multiplication_4)
move = Move(Geometry=deconstruct_plane.Origin, Motion=addition_2)  # -> Geometry, Transform
interpolate = Interpolate(Vertices=move.Geometry, Degree=3, Periodic=False, KnotStyle=1)  # -> Curve, Length, Domain
pipe = Pipe(Curve=interpolate.Curve, Radius=1, Caps=0)
