# Grasshopper definition GomezBasicshapes_WSII_2019.gh (Grasshopper 1.0.7)
# plug-ins: Bifocals

number_slider = Slider(13, range=0..100)
# Great Intro
construct_point = ConstructPoint(XCoordinate=0, YCoordinate=0, ZCoordinate=0)
multiplication = Multiplication(A=number_slider, B=Slider(9, range=0..10))
polygon = Polygon(Plane=construct_point, Radius=multiplication, Segments=Slider(5, range=0..10), FilletRadius=Slider(6, range=0..10))  # -> Polygon, Length
circle = Circle(Plane=construct_point, Radius=number_slider)
golden_ratio = GoldenRatio(Factor=number_slider)
explode = Explode(Curve=polygon.Polygon, Recursive=True)  # -> Segments, Vertices
unit_z = UnitZ(Factor=Slider(10, range=0..10))
multiplication_2 = Multiplication(A=circle, B=golden_ratio)
circle_2 = Circle(Plane=explode.Vertices, Radius=multiplication_2)
amplitude = Amplitude(Vector=unit_z, Amplitude=unit_z)
extrude = Extrude(Base=polygon.Polygon, Direction=amplitude)
extrude_2 = Extrude(Base=circle, Direction=amplitude)
extrude_3 = Extrude(Base=circle_2, Direction=amplitude)
cap_holes = CapHoles(Brep=extrude_2)
cap_holes_2 = CapHoles(Brep=extrude_3)
cap_holes_3 = CapHoles(Brep=extrude)
solid_difference = SolidDifference(BrepsA=cap_holes_3, BrepsB=cap_holes)
solid_difference_2 = SolidDifference(BrepsA=solid_difference, BrepsB=cap_holes_2)
