# Grasshopper definition HexGrid.gh (Grasshopper 0.9.80)

number_slider = Slider(3, range=0..100)
hexagonal = Hexagonal(Plane=PlaneXY(0, 0, 0), Size=1, ExtentX=number_slider, ExtentY=number_slider)  # -> Cells, Points
geometry = Geometry(hexagonal.Points)
geometry_2 = Geometry(hexagonal.Cells)
negative = Negative(Value=Slider(0.26, range=0..1))
offset = Offset(Curve=geometry_2, Distance=negative, Plane=PlaneXY(0, 0, 0), Corners=1)
boundary_surfaces = BoundarySurfaces(Edges=geometry_2)  # -> flatten(Surfaces)
boundary_surfaces_2 = BoundarySurfaces(Edges=offset)  # -> flatten(Surfaces)
brep = Brep(boundary_surfaces_2)
brep_2 = Brep(boundary_surfaces)
solid_difference = SolidDifference(BrepsA=brep_2, BrepsB=brep)
