# Grasshopper definition HippocratesQuadLune.gh (Grasshopper 0.9.80)
# plug-ins: Bifocals

arc = Arc(Plane=PlaneXY(0, 0, 0), Radius=Slider(3.57, range=0..5), Angle=Domain(0, 3.141592654))  # -> Arc, Length
evaluate_curve = EvaluateCurve(Curve=reparameterize(arc.Arc), Parameter=Slider(0.81, range=0..1))  # -> Point, Tangent, Angle
evaluate_curve_2 = EvaluateCurve(Curve=reparameterize(arc.Arc), Parameter=Slider(0.39, range=0..1))  # -> Point, Tangent, Angle
evaluate_curve_3 = EvaluateCurve(Curve=reparameterize(arc.Arc), Parameter=Slider(0.73, range=0..1))  # -> Point, Tangent, Angle
pi = Pi(Factor=Slider(1.69, range=0..2))
line_sdl = LineSDL(Start=evaluate_curve_3.Point, Direction=evaluate_curve_3.Tangent, Length=1)
rotate_3d = Rotate3D(Geometry=line_sdl, Angle=pi, Center=evaluate_curve_3.Point, Axis=Vector(0, 0, 1))  # -> Geometry, Transform
point_on_curve = PointOnCurve(rotate_3d.Geometry, parameter=0.619)
arc_3pt = Arc3Pt(PointA=evaluate_curve.Point, PointB=evaluate_curve_3.Point, PointC=evaluate_curve_2.Point)  # -> Arc, Plane, Radius
arc_3pt_2 = Arc3Pt(PointA=evaluate_curve.Point, PointB=point_on_curve, PointC=evaluate_curve_2.Point)  # -> Arc, Plane, Radius
loft = Loft(
    Curves=[arc_3pt.Arc, arc_3pt_2.Arc],
    Options={Adjust=False, Closed=False, LoftEnds=0, LoftSimp=0, LoftType=0, Rebuild=10, Refit=0.01})
unit_z = UnitZ(Factor=Slider(0.76, range=0..6))
extrude = Extrude(Base=loft, Direction=unit_z)
