# Grasshopper definition HornsWSII001.gh (Grasshopper 0.9.80)
# plug-ins: Bifocals

construct_plane = ConstructPlane(Origin=Point(0, 0, 0), XAxis=Vector(-0.6663495754, 0, 2.521591296), YAxis=Vector(3.98524537, 2.82605431, 0))
range = Range(Domain=Slider(24, range=0..100), Steps=Slider(23, range=0..100))
cosine = Cosine(Value=range)
sine = Sine(Value=range)
construct_point = ConstructPoint(XCoordinate=range, YCoordinate=sine, ZCoordinate=cosine)
interpolate = Interpolate(Vertices=construct_point, Degree=3, Periodic=False, KnotStyle=1)  # -> Curve, Length, Domain
pi = Pi(Factor=expr("-x", Slider(0, range=0..2)))
ellipse = Ellipse(Plane=PlaneXY(0, 0, 0), Radius1=Slider(1.94, range=0.1..2), Radius2=Slider(1.53, range=0.1..2))  # -> Ellipse, Focus1, Focus2
pi_2 = Pi(Factor=Slider(0.55, range=0.1..1))
yz_plane = YZPlane(Origin=Point(0, 0, 0))
rotate = Rotate(Geometry=interpolate.Curve, Angle=pi, Plane=construct_plane)  # -> Geometry, Transform
rotate_2 = Rotate(Geometry=ellipse.Ellipse, Angle=pi_2, Plane=yz_plane)  # -> Geometry, Transform
sweep1 = Sweep1(Rail=rotate.Geometry, Sections=rotate_2.Geometry, Miter=1)
cap_holes = CapHoles(Brep=sweep1)
xz_plane = XZPlane(Origin=Point(0, 0, 0))
mirror = Mirror(Geometry=cap_holes, Plane=PlaneYZ(0, 0, 0))  # -> Geometry, Transform
unit_y = UnitY(Factor=Slider(4, range=0..100))
brep_join = BrepJoin(Breps=[cap_holes, mirror.Geometry])  # -> Breps, Closed
move = Move(Geometry=brep_join.Breps, Motion=expr("-x", unit_y))  # -> Geometry, Transform
mirror_2 = Mirror(Geometry=move.Geometry, Plane=xz_plane)  # -> Geometry, Transform
brep_join_2 = BrepJoin(Breps=[mirror_2.Geometry, move.Geometry])  # -> Breps, Closed
