# Grasshopper definition ImageSamplerExtrusion.gh (Grasshopper 0.9.80)
# plug-ins: Bifocals

number_slider = Slider(1000, range=0..1000)
number_slider_2 = Slider(96, range=0..100)
rectangle = Rectangle(Plane=PlaneXY(0, 0, 0), XSize=number_slider, YSize=number_slider, Radius=0)  # -> Rectangle, Length
rectangular_array = RectangularArray(Geometry=rectangle.Rectangle, Cell=rectangle.Rectangle, XCount=number_slider_2, YCount=number_slider_2)  # -> Geometry, Transform
area = Area(Geometry=rectangular_array.Geometry)  # -> Area, Centroid
bounding_box = BoundingBox(Content=rectangular_array.Geometry, Plane=PlaneXY(0, 0, 0), UnionBox=True)  # -> Box, Box_2
surface_closest_point = SurfaceClosestPoint(Point=area.Centroid, Surface=reparameterize(bounding_box.Box))  # -> Point, UVPoint, Distance
image_sampler = ImageSampler(
    surface_closest_point.UVPoint,
    FilePath="/Users/mwickerson/Desktop/32186675_1760877197288879_7983501217147912192_n.jpg",
    Filter="Colour",
    Interpolate=False,
    Umax=1,
    Umin=0,
    Vmax=1,
    Vmin=0,
    Wrap=0)
construct_domain = ConstructDomain(DomainStart=Slider(10, range=0..10), DomainEnd=Slider(480, range=0..1000))
bounds = Bounds(Numbers=image_sampler)
remap_numbers = RemapNumbers(Value=image_sampler, Source=bounds, Target=construct_domain)  # -> Mapped, Clipped
unit_z = UnitZ(Factor=remap_numbers.Mapped)
extrude = Extrude(Base=rectangular_array.Geometry, Direction=unit_z)
