# Grasshopper definition ImageSampler_WSII_2019.gh (Grasshopper 1.0.7)
# plug-ins: Bifocals

number_slider = Slider(0.04078, range=0..1)
rectangular = Rectangular(
    Plane=PlaneXY(0, 0, 0),
    SizeX=number_slider,
    SizeY=number_slider,
    ExtentX=Slider(741, range=0..1000),
    ExtentY=Slider(805, range=0..1000))  # -> Cells, Points
image_sampler = ImageSampler(rectangular.Points, Filter="Saturation", Interpolate=True, Umax=40, Umin=0, Vmax=40, Vmin=0, Wrap=0)
division = Division(A=image_sampler, B=Slider(29.294, range=0..100))
circle_cnr = CircleCNR(Center=rectangular.Points, Normal=Vector(0, 0, 1), Radius=division)
