# Grasshopper definition January 22nd copy.gh (Grasshopper 0.9.80)

integer = Integer(1)
point = Point(Point(0, 0, 0))
vector_xyz = VectorXYZ(XComponent=integer, YComponent=0, ZComponent=0)  # -> Vector, Length
vector_xyz_2 = VectorXYZ(XComponent=0, YComponent=integer, ZComponent=0)  # -> Vector, Length
vector_xyz_3 = VectorXYZ(XComponent=0, YComponent=0, ZComponent=integer)  # -> Vector, Length
vector_xyz_4 = VectorXYZ(XComponent=integer, YComponent=integer, ZComponent=integer)  # -> Vector, Length
multiplication = Multiplication(A=[vector_xyz.Vector, vector_xyz_2.Vector, vector_xyz_3.Vector, vector_xyz_4.Vector], B=Slider(4, range=0..100))
line = Line(StartPoint=point, EndPoint=multiplication)
point_on_curve = PointOnCurve(line, parameter=1)
list_item = ListItem(List=point_on_curve, Index=0, Wrap=True)  # -> Item, Item1, Item2, Item3
number_slider = Slider(4, range=0..10)
_4point_surface = _4PointSurface(CornerA=list_item.Item3, CornerB=list_item.Item2, CornerC=list_item.Item1, CornerD=list_item.Item)
divide_domain² = DivideDomain²(Domain=_4point_surface, UCount=number_slider, VCount=number_slider)
isotrim = Isotrim(Surface=_4point_surface, Domain=divide_domain²)
