# Grasshopper definition January 22nd.gh (Grasshopper 0.9.80)

integer = Integer(1)
point = Point(Point(0, 0, 0))
number_slider = Slider(2, range=0..10)
vector_xyz = VectorXYZ(XComponent=integer, YComponent=0, ZComponent=0)  # -> Vector, Length
vector_xyz_2 = VectorXYZ(XComponent=0, YComponent=integer, ZComponent=0)  # -> Vector, Length
vector_xyz_3 = VectorXYZ(XComponent=0, YComponent=0, ZComponent=integer)  # -> Vector, Length
multiplication = Multiplication(A=[vector_xyz.Vector, vector_xyz_2.Vector, vector_xyz_3.Vector], B=Slider(12, range=0..100))
xz_plane = XZPlane(Origin=Point(0, 0, 0))
line = Line(StartPoint=point, EndPoint=multiplication)
offset = Offset(Curve=line, Distance=Slider(5, range=0..10), Plane=xz_plane, Corners=1)
