# Grasshopper definition January12th.gh (Grasshopper 0.9.80)
# plug-ins: Bifocals

number_slider = Slider(9, range=0..100)
series = Series(Start=Slider(0, range=0..100), Step=Slider(3, range=0..100), Count=number_slider)
construct_point = ConstructPoint(XCoordinate=series, YCoordinate=graft(series), ZCoordinate=0)  # -> flatten(Point)
unit_z = UnitZ(Factor=Slider(27, range=0..100))
flip_matrix = FlipMatrix()
surface_from_points = SurfaceFromPoints(Points=construct_point, UCount=number_slider, Interpolate=Toggle(False))
polyline = PolyLine(Vertices=flip_matrix, Closed=False)
surface = Surface(surface_from_points)
area = Area(Geometry=surface)  # -> Area, Centroid
move = Move(Geometry=area.Centroid, Motion=unit_z)  # -> Geometry, Transform
deconstruct_brep = DeconstructBrep(Brep=surface)  # -> Faces, Edges, Vertices
geometry = Geometry(deconstruct_brep.Edges)
geometry_2 = Geometry(deconstruct_brep.Vertices)
line = Line(StartPoint=geometry_2, EndPoint=move.Geometry)
geometry_3 = Geometry(deconstruct_brep.Faces)
loft = Loft(Curves=line, Options={Adjust=False, Closed=False, LoftEnds=0, LoftSimp=0, LoftType=0, Rebuild=10, Refit=0.01})
unit_x = UnitX(Factor=1)
list_item = ListItem(List=geometry, Index=Slider(1, range=0..3), Wrap=True)
move_2 = Move(Geometry=list_item, Motion=unit_x)  # -> Geometry, Transform
