# Grasshopper definition January13th.gh (Grasshopper 0.9.80)
# plug-ins: Bifocals

number_slider = Slider(5, range=0..100)
plane_surface = PlaneSurface(Plane=PlaneXY(0, 0, 0), XSize=Slider(8, range=0..10), YSize=Slider(15, range=0..100))
surface = Surface(plane_surface)
deconstruct_brep = DeconstructBrep(Brep=surface)  # -> Faces, Edges, Vertices
pi = Pi(Factor=Slider(-0.41, range=-0.5..0.5))
list_item = ListItem(List=deconstruct_brep.Vertices, Index=Slider(0, range=0..3), Wrap=True)
list_item_2 = ListItem(List=deconstruct_brep.Vertices, Index=Slider(3, range=0..3), Wrap=True)
line = Line(StartPoint=list_item, EndPoint=list_item_2)
rotate_axis = RotateAxis(Geometry=surface, Angle=pi, Axis=line)  # -> Geometry, Transform
deconstruct_brep_2 = DeconstructBrep(Brep=rotate_axis.Geometry)  # -> Faces, Edges, Vertices
list_item_3 = ListItem(List=deconstruct_brep_2.Vertices, Index=Slider(1, range=0..3), Wrap=True)  # -> Item, Item1
yz_plane = YZPlane(Origin=list_item_3.Item1)
deconstruct = Deconstruct(Point=list_item_3.Item)  # -> XComponent, YComponent, ZComponent
mirror = Mirror(Geometry=rotate_axis.Geometry, Plane=yz_plane)  # -> Geometry, Transform
unit_x = UnitX(Factor=deconstruct.XComponent)
linear_array = LinearArray(Geometry=mirror.Geometry, Direction=expr("2*x", unit_x), Count=number_slider)  # -> Geometry, Transform
linear_array_2 = LinearArray(Geometry=rotate_axis.Geometry, Direction=expr("2*x", unit_x), Count=number_slider)  # -> Geometry, Transform
