# Grasshopper definition January17.gh (Grasshopper 0.9.80)
# plug-ins: Bifocals

number_slider = Slider(14, range=0..100)
plane_surface = PlaneSurface(Plane=PlaneXY(0, 0, 0), XSize=Slider(56, range=0..100), YSize=Slider(59, range=0..100))
surface = Surface(plane_surface)
divide_surface = DivideSurface(Surface=surface, UCount=number_slider, VCount=number_slider)  # -> Points, Normals, Parameters
geometry = Geometry(divide_surface.Parameters)
move = Move(Geometry=geometry, Motion=Vector(0, 0, 10))  # -> Geometry, Transform
line = Line(StartPoint=geometry, EndPoint=move.Geometry)
xz_plane = XZPlane(Origin=Point(0, 0, 0))
pi = Pi(Factor=Slider(1.32, range=0..2))
pipe = Pipe(Curve=line, Radius=Slider(0.35, range=0..1), Caps=Slider(2, range=0..2))
rotate = Rotate(Geometry=pipe, Angle=pi, Plane=xz_plane)  # -> Geometry, Transform
