# Grasshopper definition January20th copy.gh (Grasshopper 0.9.80)
# plug-ins: Bifocals

number_slider = Slider(56, range=0..100)
number_slider_2 = Slider(0.2, range=0..40)
unit_x = UnitX(Factor=number_slider)
unit_y = UnitY(Factor=number_slider)
point_a = PointA(Point(0, 0, 0))
construct_point = ConstructPoint(XCoordinate=0, YCoordinate=unit_y, ZCoordinate=0)
construct_point_2 = ConstructPoint(XCoordinate=unit_x, YCoordinate=0, ZCoordinate=0)
unit_x_2 = UnitX(Factor=unit_x)
unit_y_2 = UnitY(Factor=construct_point_2)
line = Line(StartPoint=point_a, EndPoint=construct_point)
line_2 = Line(StartPoint=point_a, EndPoint=construct_point_2)
move = Move(Geometry=line_2, Motion=unit_y_2)  # -> Geometry, Transform
move_2 = Move(Geometry=line, Motion=unit_x_2)  # -> Geometry, Transform
end_points = EndPoints(Curve=move.Geometry)  # -> Start, End
pi = Pi(Factor=Slider(0.115, range=0..1))
join_curves = JoinCurves(Curves=[move_2.Geometry, move.Geometry], Preserve=False)
negative = Negative(Value=pi)
point = Point(end_points.End)
point_2 = Point(point_a)
point_3 = Point(construct_point_2)
point_4 = Point(end_points.Start)
rotate = Rotate(Geometry=join_curves, Angle=negative, Plane=point_3)  # -> Geometry, Transform
point_on_curve = PointOnCurve(rotate.Geometry, parameter=1)
join_curves_2 = JoinCurves(Curves=[line_2, line], Preserve=False)
line_3 = Line(StartPoint=point_on_curve, EndPoint=point_4)
join_curves_3 = JoinCurves(Curves=[join_curves_2, rotate.Geometry, line_3], Preserve=False)
explode = Explode(Curve=join_curves_3, Recursive=True)  # -> Segments, Vertices
unit_z = UnitZ(Factor=Slider(100, range=0..100))
area = Area(Geometry=join_curves_3)  # -> Area, Centroid
list_item = ListItem(List=explode.Segments, Index=0, Wrap=True)  # -> Item, Item1, Item2, Item3, Item4
list_item_2 = ListItem(List=explode.Vertices, Index=0, Wrap=True)  # -> Item, Item1, Item2, Item3, Item4
move_3 = Move(Geometry=area.Centroid, Motion=unit_z)  # -> Geometry, Transform
point_on_curve_2 = PointOnCurve(list_item.Item1, parameter=0.5)
point_on_curve_3 = PointOnCurve(list_item.Item1, parameter=0)
point_on_curve_4 = PointOnCurve(list_item.Item1, parameter=1)
point_5 = Point(list_item_2.Item)
point_6 = Point(list_item_2.Item1)
point_7 = Point(list_item_2.Item2)
point_8 = Point(list_item_2.Item4)
point_9 = Point(list_item_2.Item3)
line_4 = Line(StartPoint=area.Centroid, EndPoint=point_on_curve_2)
vector_2pt = Vector2Pt(PointA=area.Centroid, PointB=point_on_curve_2, Unitize=False)  # -> Vector, Length
vector = Vector(vector_2pt.Vector)
multiplication = Multiplication(A=vector, B=Slider(0.4, range=0..2))
move_4 = Move(Geometry=point_on_curve_2, Motion=multiplication)  # -> Geometry, Transform
circle_cnr = CircleCNR(Center=area.Centroid, Normal=Vector(0, 0, 1), Radius=number_slider_2)
circle_cnr_2 = CircleCNR(Center=area.Centroid, Normal=Vector(0, 0, 1), Radius=number_slider_2)
arc_3pt = Arc3Pt(PointA=point_6, PointB=move_4.Geometry, PointC=point_7)  # -> Arc, Plane, Radius
curve_curve = CurveCurve(CurveA=circle_cnr, CurveB=line_4)  # -> Points, ParamsA, ParamsB
curve = Curve()
curve_2 = Curve()
curve_3 = Curve(list_item.Item)
curve_4 = Curve(list_item.Item1)
move_5 = Move(Geometry=arc_3pt.Arc, Motion=unit_z)  # -> Geometry, Transform
move_6 = Move(Geometry=circle_cnr_2, Motion=unit_z)  # -> Geometry, Transform
point_on_curve_5 = PointOnCurve(move_5.Geometry, parameter=0)
point_on_curve_6 = PointOnCurve(move_5.Geometry, parameter=1)
divide_curve = DivideCurve(Curve=move_6.Geometry, Count=Slider(2, range=0..10), Kinks=False)  # -> flatten(Points), Tangents, Parameters
list_item_3 = ListItem(List=divide_curve.Points, Index=Slider(7, range=0..10), Wrap=True)  # -> Item, Item1
line_5 = Line(StartPoint=list_item_3.Item, EndPoint=list_item_3.Item1)
line_6 = Line(StartPoint=list_item_3.Item1, EndPoint=point_on_curve_6)
line_7 = Line(StartPoint=list_item_3.Item, EndPoint=point_on_curve_5)
number_slider_3 = Slider(6, range=0..10)
arc_3pt_2 = Arc3Pt(PointA=list_item_3.Item, PointB=point_on_curve_5, PointC=point_on_curve_3)  # -> Arc, Plane, Radius
arc_3pt_3 = Arc3Pt(PointA=list_item_3.Item1, PointB=point_on_curve_6, PointC=point_on_curve_4)  # -> Arc, Plane, Radius
sweep2 = Sweep2(Rail1=arc_3pt_2.Arc, Rail2=arc_3pt_3.Arc, Sections=line_5, SameHeight=False)
brep = Brep(sweep2)
divide_surface = DivideSurface(Surface=sweep2, UCount=number_slider_3, VCount=number_slider_3)  # -> Points, Normals, Parameters
offset = Offset(Surface=sweep2, Distance=Slider(1, range=0..100), Retrim=True)
brep_2 = Brep(offset)
deconstruct_brep = DeconstructBrep(Brep=offset)  # -> Faces, Edges, Vertices
deconstruct_brep_2 = DeconstructBrep(Brep=sweep2)  # -> Faces, Edges, Vertices
list_item_4 = ListItem(List=deconstruct_brep.Vertices, Index=Slider(1, range=0..10), Wrap=True)
point_10 = Point(list_item_4)
xy_plane = XYPlane(Origin=Point(0, 0, 0))
join_curves_4 = JoinCurves(Curves=deconstruct_brep_2.Edges, Preserve=False)
join_curves_5 = JoinCurves(Curves=deconstruct_brep.Edges, Preserve=False)
loft = Loft(
    Curves=[join_curves_5, join_curves_4],
    Options={Adjust=False, Closed=False, LoftEnds=0, LoftSimp=0, LoftType=0, Rebuild=10, Refit=0.01})
brep_3 = Brep(loft)
brep_join = BrepJoin(Breps=[brep_3, brep_2, brep])  # -> Breps, Closed
polar_array = PolarArray(Geometry=brep_join.Breps, Plane=xy_plane, Count=Slider(5, range=0..10), Angle=6.283185307)  # -> Geometry, Transform
