# Grasshopper definition January20thWSII2.0.gh (Grasshopper 0.9.80)
# plug-ins: Bifocals

md_slider = MDSlider(
    slider_value=Point(0.6402439024, 0.743902439, 0.5),
    SliderMode=0,
    x_domain=Domain(0, 1),
    y_domain=Domain(0, 1),
    z_domain=Domain(0, 1))
construct_point = ConstructPoint(XCoordinate=0, YCoordinate=0, ZCoordinate=0)
unit_z = UnitZ(Factor=Slider(15, range=0..100))

number_slider = Slider(28, range=0..100)

construct_point_2 = ConstructPoint(XCoordinate=number_slider, YCoordinate=0, ZCoordinate=0)
construct_point_3 = ConstructPoint(XCoordinate=0, YCoordinate=number_slider, ZCoordinate=0)
line = Line(StartPoint=construct_point, EndPoint=construct_point_2)
line_2 = Line(StartPoint=construct_point, EndPoint=construct_point_3)
unit_x = UnitX(Factor=number_slider)
unit_y = UnitY(Factor=number_slider)
move = Move(Geometry=line_2, Motion=unit_x)  # -> Geometry, Transform
move_2 = Move(Geometry=line, Motion=unit_y)  # -> Geometry, Transform
point_on_curve = PointOnCurve(move_2.Geometry, parameter=1)
negative = Negative(Value=Slider(0.28, range=0..1))
pi = Pi(Factor=negative)
join_curves = JoinCurves(Curves=[move_2.Geometry, move.Geometry], Preserve=False)
rotate_3d = Rotate3D(Geometry=join_curves, Angle=pi, Center=construct_point_2, Axis=Vector(0, 0, 1))  # -> Geometry, Transform
point_on_curve_2 = PointOnCurve(rotate_3d.Geometry, parameter=0)
line_3 = Line(StartPoint=point_on_curve_2, EndPoint=construct_point_3)

join_curves_2 = JoinCurves(Curves=[line_3, rotate_3d.Geometry, line_2, line], Preserve=False)

join_curves_3 = JoinCurves(Curves=join_curves_2, Preserve=False)

explode = Explode(Curve=join_curves_3, Recursive=True)  # -> Segments, Vertices
point_on_curve_3 = PointOnCurve(explode.Segments, parameter=0.5)
area = Area(Geometry=join_curves_3)  # -> Area, Centroid
line_4 = Line(explode.Segments)
point_on_curve_4 = PointOnCurve(line_4, parameter=0)
point_on_curve_5 = PointOnCurve(line_4, parameter=1)
circle_cnr = CircleCNR(Center=area.Centroid, Normal=Vector(0, 0, 1), Radius=Slider(7.4, range=0..10))

geometry = Geometry(circle_cnr)

move_3 = Move(Geometry=geometry, Motion=unit_z)  # -> Geometry, Transform
line_5 = Line(StartPoint=point_on_curve_3, EndPoint=area.Centroid)
curve_curve = CurveCurve(CurveA=line_5, CurveB=circle_cnr)  # -> flatten(Points), ParamsA, ParamsB
move_4 = Move(Geometry=curve_curve.Points, Motion=unit_z)  # -> Geometry, Transform
vector_2pt = Vector2Pt(PointA=curve_curve.Points, PointB=point_on_curve_3, Unitize=False)  # -> Vector, Length
multiplication = Multiplication(A=vector_2pt.Vector, B=Slider(1.8, range=0..2))
move_5 = Move(Geometry=curve_curve.Points, Motion=multiplication)  # -> Geometry, Transform
arc_3pt = Arc3Pt(PointA=move_4.Geometry, PointB=move_5.Geometry, PointC=point_on_curve_3)  # -> Arc, Plane, Radius
loft = Loft(Curves=arc_3pt.Arc, Options={Adjust=False, Closed=True, LoftEnds=0, LoftSimp=0, LoftType=0, Rebuild=10, Refit=0.01})
cap_holes = CapHoles(Brep=loft)
deconstruct_brep = DeconstructBrep(Brep=cap_holes)  # -> Faces, Edges, Vertices
evaluate_surface = EvaluateSurface(Surface=reparameterize(deconstruct_brep.Faces), Point=md_slider)  # -> Point, Normal, Frame
multiplication_2 = Multiplication(A=evaluate_surface.Normal, B=Slider(1, range=0..10))
offset = Offset(Surface=deconstruct_brep.Faces, Distance=multiplication_2, Retrim=True)
arc_3pt_2 = Arc3Pt(PointA=point_on_curve_4, PointB=move_5.Geometry, PointC=point_on_curve_5)  # -> Arc, Plane, Radius
