# Grasshopper definition January21.gh (Grasshopper 0.9.80)
# plug-ins: Bifocals

length = Slider(41, range=0..100)
arc_height = Slider(25.526, range=0..30)
arc_height2 = Slider(30, range=0..30)
arc_rot3 = Slider(1.383, range=0..2)
start = Start(Point(0, 0, 0))
arc_height3 = Slider(30, range=0..30)
integer = Integer(1)
integer_2 = Integer(1)
count_array = Slider(3, range=0..10)
negative = Negative(Value=arc_rot3)
vector_xyz = VectorXYZ(XComponent=0, YComponent=integer, ZComponent=0)  # -> Vector, Length
vector_xyz_2 = VectorXYZ(XComponent=integer, YComponent=0, ZComponent=0)  # -> Vector, Length
vector_xyz_3 = VectorXYZ(XComponent=0, YComponent=0, ZComponent=integer)  # -> Vector, Length
vector_xyz_4 = VectorXYZ(XComponent=integer_2, YComponent=integer_2, ZComponent=0)  # -> Vector, Length
pi = Pi(Factor=arc_rot3)
pi_2 = Pi(Factor=Slider(0.5, range=0..0.5))
pi_3 = Pi(Factor=Slider(0.325, range=0..0.5))
xy_plane = XYPlane(Origin=Point(0, 0, 0))
yz_plane = YZPlane(Origin=Point(0, 0, 0))
xz_plane = XZPlane(Origin=Point(0, 0, 0))
pi_4 = Pi(Factor=negative)
xy_plane_2 = XYPlane(Origin=Point(0, 0, 0))
line_sdl = LineSDL(Start=start, Direction=vector_xyz_2.Vector, Length=length)
line_sdl_2 = LineSDL(Start=start, Direction=vector_xyz.Vector, Length=length)
line_sdl_3 = LineSDL(Start=start, Direction=vector_xyz_3.Vector, Length=length)
point_on_curve = PointOnCurve(line_sdl, parameter=0)
point_on_curve_2 = PointOnCurve(line_sdl, parameter=0.5)
point_on_curve_3 = PointOnCurve(line_sdl, parameter=1)
point_on_curve_4 = PointOnCurve(line_sdl_2, parameter=0)
point_on_curve_5 = PointOnCurve(line_sdl_2, parameter=0.5)
point_on_curve_6 = PointOnCurve(line_sdl_2, parameter=1)
point_on_curve_7 = PointOnCurve(line_sdl_3, parameter=0)
point_on_curve_8 = PointOnCurve(line_sdl_3, parameter=0.5)
point_on_curve_9 = PointOnCurve(line_sdl_3, parameter=1)
negative_2 = Negative(Value=vector_xyz.Vector)
negative_3 = Negative(Value=vector_xyz_2.Vector)
negative_4 = Negative(Value=arc_height3)
multiplication = Multiplication(A=negative_2, B=arc_height)
multiplication_2 = Multiplication(A=negative_3, B=arc_height2)
multiplication_3 = Multiplication(A=negative_4, B=vector_xyz_4.Vector)
move = Move(Geometry=point_on_curve_2, Motion=multiplication)  # -> Geometry, Transform
move_2 = Move(Geometry=point_on_curve_5, Motion=multiplication_2)  # -> Geometry, Transform
move_3 = Move(Geometry=point_on_curve_8, Motion=multiplication_3)  # -> Geometry, Transform
arc_3pt = Arc3Pt(PointA=point_on_curve, PointB=move.Geometry, PointC=point_on_curve_3)  # -> Arc, Plane, Radius
join_curves = JoinCurves(Curves=arc_3pt.Arc, Preserve=False)
rotate_3d = Rotate3D(Geometry=join_curves, Angle=pi_2, Center=move.Geometry, Axis=yz_plane)  # -> Geometry, Transform
point_on_curve_10 = PointOnCurve(rotate_3d.Geometry, parameter=0)
point_on_curve_11 = PointOnCurve(rotate_3d.Geometry, parameter=1)
line = Line(StartPoint=point_on_curve_11, EndPoint=point_on_curve_3)  # -> flatten(Line)
line_2 = Line(StartPoint=point_on_curve_10, EndPoint=point_on_curve)
arc_3pt_2 = Arc3Pt(PointA=point_on_curve_4, PointB=move_2.Geometry, PointC=point_on_curve_6)  # -> Arc, Plane, Radius
join_curves_2 = JoinCurves(Curves=arc_3pt_2.Arc, Preserve=False)
rotate_3d_2 = Rotate3D(Geometry=join_curves_2, Angle=pi_3, Center=move_2.Geometry, Axis=xz_plane)  # -> Geometry, Transform
point_on_curve_12 = PointOnCurve(rotate_3d_2.Geometry, parameter=0)
point_on_curve_13 = PointOnCurve(rotate_3d_2.Geometry, parameter=1)
line_3 = Line(StartPoint=point_on_curve_13, EndPoint=point_on_curve_6)  # -> flatten(Line)
line_4 = Line(StartPoint=point_on_curve_12, EndPoint=point_on_curve_4)
arc_3pt_3 = Arc3Pt(PointA=point_on_curve_7, PointB=move_3.Geometry, PointC=point_on_curve_9)  # -> Arc, Plane, Radius
join_curves_3 = JoinCurves(Curves=arc_3pt_3.Arc, Preserve=False)
join_curves_4 = JoinCurves(Curves=arc_3pt_3.Arc, Preserve=False)
rotate_3d_3 = Rotate3D(Geometry=arc_3pt_3.Arc, Angle=pi, Center=move_3.Geometry, Axis=xy_plane)  # -> Geometry, Transform
rotate_3d_4 = Rotate3D(Geometry=arc_3pt_3.Arc, Angle=pi_4, Center=move_3.Geometry, Axis=xy_plane_2)  # -> Geometry, Transform
point_on_curve_14 = PointOnCurve(rotate_3d_3.Geometry, parameter=0)
point_on_curve_15 = PointOnCurve(rotate_3d_3.Geometry, parameter=1)
point_on_curve_16 = PointOnCurve(rotate_3d_4.Geometry, parameter=0)
point_on_curve_17 = PointOnCurve(rotate_3d_4.Geometry, parameter=1)
line_5 = Line(StartPoint=point_on_curve_16, EndPoint=point_on_curve_7)
line_6 = Line(StartPoint=point_on_curve_17, EndPoint=point_on_curve_9)
line_7 = Line(StartPoint=point_on_curve_14, EndPoint=point_on_curve_7)

sweep1 = Sweep1(Rail=rotate_3d_2.Geometry, Sections=[line_3, line_4], Miter=1)  # -> flatten(Brep)
sweep1_2 = Sweep1(Rail=rotate_3d.Geometry, Sections=[line, line_2], Miter=1)  # -> flatten(Brep)
sweep1_3 = Sweep1(Rail=rotate_3d_3.Geometry, Sections=line_7, Miter=1)  # -> flatten(Brep)
sweep1_4 = Sweep1(Rail=rotate_3d_4.Geometry, Sections=line_5, Miter=1)  # -> flatten(Brep)

brep_join = BrepJoin(Breps=[sweep1, sweep1_2, sweep1_3, sweep1_4])  # -> Breps, Closed
deconstruct_brep = DeconstructBrep(Brep=brep_join.Breps)  # -> Faces, Edges, flatten(Vertices)
list_item = ListItem(List=deconstruct_brep.Vertices, Index=0, Wrap=True)
line_8 = Line(StartPoint=point_on_curve_15, EndPoint=point_on_curve_9)

polar_array = PolarArray(Geometry=brep_join.Breps, Plane=list_item, Count=count_array, Angle=6.283185307)  # -> flatten(Geometry), Transform

deconstruct_brep_2 = DeconstructBrep(Brep=polar_array.Geometry)  # -> Faces, Edges, flatten(Vertices)
list_item_2 = ListItem(List=deconstruct_brep_2.Vertices, Index=Slider(7, range=0..10), Wrap=True)
polar_array_2 = PolarArray(Geometry=brep_join.Breps, Plane=list_item_2, Count=count_array, Angle=6.283185307)  # -> flatten(Geometry), Transform

brep_join_2 = BrepJoin(Breps=polar_array_2.Geometry)  # -> Breps, Closed
