# Grasshopper definition January21st002.gh (Grasshopper 0.9.80)

number_slider = Slider(1, range=0..1)
start_point = StartPoint(Point(0, 0, 0))
integer = Integer(1)
vector_xyz = VectorXYZ(XComponent=integer, YComponent=0, ZComponent=0)  # -> Vector, Length
vector_xyz_2 = VectorXYZ(XComponent=0, YComponent=integer, ZComponent=0)  # -> Vector, Length
vector_xyz_3 = VectorXYZ(XComponent=0, YComponent=0, ZComponent=integer)  # -> Vector, Length
vector = Vector([vector_xyz_2.Vector, vector_xyz.Vector, vector_xyz_3.Vector])
line = Line(StartPoint=start_point, EndPoint=vector)
explode = Explode(Curve=line, Recursive=True)  # -> Segments, Vertices
point_on_curve = PointOnCurve(line, parameter=0)
point_on_curve_2 = PointOnCurve(line, parameter=0.5)
point_on_curve_3 = PointOnCurve(line, parameter=1)
evaluate_curve = EvaluateCurve(Curve=line, Parameter=explode.Vertices)  # -> Point, Tangent, Angle
pi = Pi(Factor=Slider(0.96, range=0..2))
rotate = Rotate(Geometry=evaluate_curve.Tangent, Angle=pi, Plane=PlaneXY(0, 0, 0))  # -> Geometry, Transform
line_2 = Line(StartPoint=point_on_curve_3, EndPoint=rotate.Geometry)
pipe = Pipe(Curve=line_2, Radius=Slider(0.02, range=0.01..0.3), Caps=2)
polar_array = PolarArray(Geometry=pipe, Plane=point_on_curve_3, Count=Slider(6, range=0..6), Angle=6.283185307)  # -> Geometry, Transform
