# Grasshopper definition January25.gh (Grasshopper 0.9.80)
# plug-ins: Bifocals

plane_surface = PlaneSurface(Plane=PlaneXY(0, 0, 0), XSize=Slider(37, range=0..100), YSize=Slider(40, range=0..100))
divide_domain² = DivideDomain²(Domain=plane_surface, UCount=Slider(2, range=0..100), VCount=Slider(2, range=0..100))
unit_z = UnitZ(Factor=Slider(22, range=0..100))
isotrim = Isotrim(Surface=plane_surface, Domain=divide_domain²)  # -> flatten(Surface)
area = Area(Geometry=isotrim)  # -> Area, Centroid
brep = Brep(isotrim)
explode = Explode(Curve=isotrim, Recursive=True)  # -> Segments, Vertices
move = Move(Geometry=area.Centroid, Motion=unit_z)  # -> graft(Geometry), Transform
deconstruct_brep = DeconstructBrep(Brep=brep)  # -> Faces, Edges, graft(Vertices)
_4point_surface = _4PointSurface(CornerA=explode.Vertices, CornerB=move.Geometry, CornerC=deconstruct_brep.Vertices, CornerD=move.Geometry)
