# Grasshopper definition Learning Surface WSII.gh (Grasshopper 0.9.80)
# plug-ins: Bifocals

# ----
# Analysis
box_rectangle = BoxRectangle(
    Rectangle={Plane=PlaneXY(-13.97519397, -9.454186217, 0), Size=Domain2(u=0..27.33995566, v=0..17.93844548)},
    Height=Domain(0, 10))
box_properties = BoxProperties(Box=box_rectangle)  # -> Center, Diagonal, Area, Volume, Degeneracy
evaluate_box = EvaluateBox(Box=box_rectangle, UParameter=0.5, VParameter=0.5, WParameter=0.5)  # -> Plane, Point, Include
box_corners = BoxCorners(Box=box_rectangle)  # -> CornerA, CornerB, CornerC, CornerD, CornerE, CornerF, CornerG, CornerH
deconstruct_box = DeconstructBox(Box=box_rectangle)  # -> Plane, X, Y, Z
brep_edges = BrepEdges(Brep=box_rectangle)  # -> Naked, Interior, NonManifold
brep_topology = BrepTopology(Brep=box_rectangle, PerspectiveOnly=False)  # -> FaceFaceAdjacency, FaceEdgeAdjacency, EdgeFaceAdjacency
brep_wireframe = BrepWireframe(Brep=box_rectangle, Density=-1)
deconstruct_brep = DeconstructBrep(Brep=box_rectangle)  # -> Faces, Edges, Vertices
surface_points = SurfacePoints(Surface=deconstruct_brep.Faces)  # -> Points, Weights, Greville, UCount, VCount
dimensions = Dimensions(Surface=deconstruct_brep.Faces)  # -> UDimension, VDimension
is_planar = IsPlanar(Surface=deconstruct_brep.Faces, Interior=True)  # -> Planar, Plane
volume_moments = VolumeMoments()  # -> Volume, Centroid, Inertia, InertiaError, Secondary, SecondaryError, Gyration
area_moments = AreaMoments(Geometry=box_rectangle)  # -> Area, Centroid, Inertia, InertiaError, Secondary, SecondaryError, Gyration
volume = Volume(Geometry=box_rectangle)  # -> Volume, Centroid
area = Area(Geometry=box_rectangle)  # -> Area, Centroid
surface_closest_point = SurfaceClosestPoint(Point=box_corners.CornerB, Surface=deconstruct_brep.Faces)  # -> Point, UVPoint, Distance
brep_closest_point = BrepClosestPoint(Point=box_corners.CornerA, Brep=box_rectangle)  # -> Point, Normal, Distance
brep_closest_point_2 = BrepClosestPoint(Point=deconstruct_brep.Vertices, Brep=box_rectangle)  # -> Point, Normal, Distance
point_in_brep = PointInBrep(Strict=False)
point_in_breps = PointInBreps(Strict=False)  # -> Inside, Index
point_in_trim = PointInTrim()
shape_in_brep = ShapeInBrep()
surface_curvature = SurfaceCurvature()  # -> Frame, Gaussian, Mean
principal_curvature = PrincipalCurvature()  # -> Frame, Min, Max, MinDirection, MaxDirection
evaluate_surface = EvaluateSurface(Surface=deconstruct_brep.Faces, Point=area.Centroid)  # -> Point, Normal, Frame
osculating_circles = OsculatingCircles(Surface=deconstruct_brep.Faces, Point=evaluate_surface.Point)  # -> Point, FirstCircle, SecondCircle

# ----
# Primitive
number_slider = Slider(47, range=0..100)
plane_through_shape = PlaneThroughShape(Inflate=1, SectionLogic=False)
plane_surface = PlaneSurface(Plane=PlaneXY(0, 0, 0), XSize=Domain(-10, 10), YSize=Domain(-10, 10))
box_2pt = Box2Pt(Plane=PlaneXY(0, 0, 0))
bounding_box = BoundingBox(Content=plane_surface, Plane=PlaneXY(0, 0, 0))  # -> Box, Box_2
box_rectangle_2 = BoxRectangle(Height=Domain(0, 10))
domain_box = DomainBox(Base=PlaneXY(0, 0, 0), X=Domain(-2, 2), Y=Domain(-0.5, 0.5), Z=Domain(0, 0.25))
center_box = CenterBox(Base=PlaneXY(0, 0, 0), X=1, Y=1, Z=1)
sphere_fit = SphereFit()  # -> Center, Radius, Sphere
sphere_4pt = Sphere4Pt()  # -> Center, Radius, Sphere
cylinder = Cylinder(Base=PlaneXY(0, 0, 0), Radius=0.5, Length=1)
sphere = Sphere(Base=PlaneXY(0, 0, 0), Radius=1)
cone = Cone(Base=PlaneXY(0, 0, 0), Radius=number_slider, Length=number_slider)  # -> Cone, Tip

# ----
# Utility
divide_surface = DivideSurface(UCount=10, VCount=10)  # -> Points, Normals, Parameters
surface_frames = SurfaceFrames(UCount=10, VCount=10)  # -> Frames, Parameters
isotrim = Isotrim()
copy_trim = CopyTrim()
untrim = Untrim()
retrim = Retrim()
merge_faces = MergeFaces()  # -> Breps, Before, After
brep_join = BrepJoin()  # -> Breps, Closed
cap_holes_ex = CapHolesEx()  # -> Brep, Caps, Solid
cap_holes = CapHoles()
offset_loose = OffsetLoose(Distance=0, Retrim=True)
offset = Offset(Distance=0, Retrim=True)
flip = Flip()  # -> Surface, Result

# ----
# Analysis
number_slider_2 = Slider(5, range=0..10)
number_slider_3 = Slider(4, range=0..10)
_4point_surface = _4PointSurface(
    CornerA=Point(12.20815016, 15.98500787, 0),
    CornerB=Point(-24.60686167, 16.58288594, 0),
    CornerC=Point(-24.9582464, -14.67889501, 0),
    CornerD=Point(10.90576057, -13.0946237, 0))
number_slider_4 = Slider(12, range=0..100)
loft = Loft(Options={Adjust=False, Closed=False, LoftEnds=0, LoftSimp=0, LoftType=0, Rebuild=10, Refit=0.01})
edge_surface = EdgeSurface()
loft_options = LoftOptions(Closed=False, Adjust=False, Rebuild=0, Refit=0, Type=0)
divide_surface_2 = DivideSurface(Surface=_4point_surface, UCount=number_slider_2, VCount=number_slider_2)  # -> Points, Normals, Parameters
series = Series(Start=0, Step=number_slider_4, Count=number_slider_4)
network_surface = NetworkSurface(Continuity=2)
sum_surface = SumSurface()
ruled_surface = RuledSurface()
construct_point = ConstructPoint(XCoordinate=series, YCoordinate=graft(series), ZCoordinate=0)  # -> flatten(Point)
extrude_linear = ExtrudeLinear(OrientationP=PlaneXY(0, 0, 0))
extrude = Extrude()
extrude_along = ExtrudeAlong()
extrude_point = ExtrudePoint()
surface_from_points = SurfaceFromPoints(Points=construct_point, UCount=number_slider_4, Interpolate=True)
boundary_surfaces = BoundarySurfaces(Edges=surface_from_points)
pipe_variable = PipeVariable(Caps=0)
pipe = Pipe(Radius=1, Caps=0)
patch = Patch(Spans=20, Flexibility=1, Trim=True)
fragment_patch = FragmentPatch()
sweep2 = Sweep2(SameHeight=False)
sweep1 = Sweep1(Miter=1)
rail_revolution = RailRevolution(Scale=False)
revolution = Revolution(Domain=Domain(0, 6.283185307))
