# Grasshopper definition LearningCurveWSII.gh (Grasshopper 0.9.80)
# plug-ins: Bifocals

yz_plane = YZPlane(Origin=Point(0, 0, 0))
xy_plane = XYPlane(Origin=Point(0, 0, 0))
polygon = Polygon(Plane=yz_plane, Radius=Slider(25, range=0..100), Segments=Slider(4, range=0..10), FilletRadius=Slider(10, range=0..10))  # -> Polygon, Length
polygon_2 = Polygon(Plane=xy_plane, Radius=Slider(29, range=0..100), Segments=Slider(4, range=0..10), FilletRadius=Slider(0, range=0..10))  # -> Polygon, Length
curve_proximity = CurveProximity(CurveA=polygon_2.Polygon, CurveB=polygon.Polygon)  # -> PointA, PointB, Distance
number = Number(polygon_2.Length)
geometry = Geometry(polygon_2.Polygon)
discontinuity = Discontinuity(Curve=polygon.Polygon, Level=1)  # -> Points, Parameters
polygon_center = PolygonCenter(Polyline=polygon_2.Polygon)  # -> CenterV, CenterE, CenterA
control_points = ControlPoints(Curve=geometry)  # -> Points, Weights, Knots
end_points = EndPoints(Curve=polygon_2.Polygon)  # -> Start, End
control_polygon = ControlPolygon(Curve=polygon_2.Polygon)  # -> Polygon, Points
line = Line(StartPoint=curve_proximity.PointA, EndPoint=curve_proximity.PointB)
number_2 = Number(control_points.Knots)
extremes = Extremes(Curve=polygon.Polygon, Plane=PlaneXY(0, 0, 0))  # -> Highest, Lowest
curve = Curve(control_polygon.Polygon)
integer = Integer(control_points.Weights)
point = Point(control_polygon.Points)
point_2 = Point()
curve_side = CurveSide(Curve=polygon.Polygon, Point=curve_proximity.PointA)  # -> Side, Left, Right
curve_nearest_object = CurveNearestObject(Curve=polygon_2.Polygon)  # -> PointA, PointB, Index
curve_closest_point = CurveClosestPoint(Point=control_points.Points, Curve=polygon_2.Polygon)  # -> Point, Parameter, Distance
closed = Closed(Curve=polygon_2.Polygon)  # -> Closed, Periodic
curvature_graph = CurvatureGraph(Curve=polygon_2.Polygon, Density=5, Scale=105)
point_3 = Point(extremes.Lowest)
boolean = Boolean(closed.Closed)
