# Grasshopper definition LearningCurveWSII002.gh (Grasshopper 0.9.80)
# plug-ins: Bifocals

xz_plane = XZPlane(Origin=Point(0, 0, 0))
xy_plane = XYPlane(Origin=Point(0, 0, 0))
yz_plane = YZPlane(Origin=Point(0, 0, 0))
# Analysis
number_slider = Slider(29, range=0..100)
xy_plane_2 = XYPlane(Origin=Point(0, 0, 0))
polygon = Polygon(Plane=xz_plane, Radius=Slider(21, range=0..100), Segments=Slider(5, range=0..10), FilletRadius=Slider(6, range=0..10))  # -> Polygon, Length
segment_lengths = SegmentLengths(Curve=polygon.Polygon)  # -> ShortestLength, ShortestDomain, LongestLength, LongestDomain
point_in_curves = PointInCurves()  # -> Relationship, Index, Point
length = Length(Curve=polygon.Polygon)
length_domain = LengthDomain(Curve=polygon.Polygon, Domain=Slider(32, range=0..100))
polygon_2 = Polygon(Plane=yz_plane, Radius=Slider(25, range=0..100), Segments=Slider(4, range=0..10), FilletRadius=Slider(10, range=0..10))  # -> Polygon, Length
point_on_curve = PointOnCurve(polygon_2.Polygon, parameter=0.286)
horizontal_frame = HorizontalFrame(Curve=polygon_2.Polygon, Parameter=xy_plane)
polygon_3 = Polygon(Plane=xy_plane_2, Radius=number_slider, Segments=Slider(4, range=0..10), FilletRadius=Slider(0, range=0..10))  # -> Polygon, Length
evaluate_length = EvaluateLength(Curve=polygon.Polygon, Length=0, Normalized=True)  # -> Point, Tangent, Parameter
point_in_curve = PointInCurve(Point=evaluate_length.Point, Curve=polygon.Polygon)  # -> Relationship, Point
perp_frame = PerpFrame(Curve=polygon.Polygon, Parameter=evaluate_length.Parameter)
length_parameter = LengthParameter(Curve=polygon.Polygon, Parameter=evaluate_length.Parameter)  # -> Length, Length_2
curve_proximity = CurveProximity(CurveA=polygon_3.Polygon, CurveB=polygon_2.Polygon)  # -> PointA, PointB, Distance
number = Number(polygon_3.Length)
geometry = Geometry(polygon_3.Polygon)
discontinuity = Discontinuity(Curve=polygon_2.Polygon, Level=1)  # -> Points, Parameters
torsion = Torsion(Curve=polygon_2.Polygon, Parameter=point_on_curve)  # -> Point, Torsion
panel = Panel(point_in_curve.Point)
polygon_center = PolygonCenter(Polyline=polygon_3.Polygon)  # -> CenterV, CenterE, CenterA
control_points = ControlPoints(Curve=geometry)  # -> Points, Weights, Knots
end_points = EndPoints(Curve=polygon_3.Polygon)  # -> Start, End
control_polygon = ControlPolygon(Curve=polygon_3.Polygon)  # -> Polygon, Points
geometry_2 = Geometry(evaluate_length.Tangent)
line = Line(StartPoint=curve_proximity.PointA, EndPoint=curve_proximity.PointB)
line_2 = Line(StartPoint=torsion.Point, EndPoint=point_on_curve)
extremes = Extremes(Curve=polygon_2.Polygon, Plane=PlaneXY(0, 0, 0))  # -> Highest, Lowest
number_2 = Number(control_points.Knots)
curve = Curve(control_polygon.Polygon)
integer = Integer(control_points.Weights)
point = Point(control_polygon.Points)
point_2 = Point()
curve_side = CurveSide(Curve=polygon_2.Polygon, Point=curve_proximity.PointA)  # -> Side, Left, Right
curve_nearest_object = CurveNearestObject(Curve=polygon_3.Polygon)  # -> PointA, PointB, Index
curve_closest_point = CurveClosestPoint(Point=control_points.Points, Curve=polygon_3.Polygon)  # -> Point, Parameter, Distance
closed = Closed(Curve=polygon_3.Polygon)  # -> Closed, Periodic
curvature_graph = CurvatureGraph(Curve=polygon_3.Polygon, Density=5, Scale=105)
point_3 = Point(extremes.Lowest)
boolean = Boolean(closed.Closed)

# ----
# Primitive
number_slider_2 = Slider(11, range=0..100)
unit_z = UnitZ(Factor=1)
point_a = PointA(Point(18.64233213, -21.07241015, 0))
point_c = PointC(Point(-10.0544341, 24.13204983, 0))
point_b = PointB(Point(-20.46164239, -18.43206422, 0))
circle_a = CircleA({Plane=Plane(origin=(22.2938794, -14.17734488, 0), x=(-0.9963939998, 0.08484690385, 0), y=(-0.08484690385, -0.9963939998, 0)), Radius=15.61527063})
polygon_4 = Polygon(Plane=PlaneXY(0, 0, 0), Radius=3, Segments=6, FilletRadius=0)  # -> Polygon, Length
rectangle_3pt = Rectangle3Pt(PointA=point_a, PointB=point_b, PointC=point_c)  # -> Rectangle, Length
rectangle_2pt = Rectangle2Pt(Plane=PlaneXY(0, 0, 0), PointA=Point(0, 0, 0), PointB=Point(10, 5, 0), Radius=0)  # -> Rectangle, Length
rectangle = Rectangle(Plane=PlaneXY(0, 0, 0), XSize=Domain(-1, 1), YSize=Domain(-2, 2), Radius=0)  # -> Rectangle, Length
circle_a_2 = CircleA({Plane=Plane(origin=(-12.3673795, 33.37003098, 0), x=(-0.2212142501, -0.9752252332, 0), y=(0.9752252332, -0.2212142501, 0)), Radius=16.10825472})
rotate_3d = Rotate3D(Geometry=circle_a, Angle=1.570796327, Center=Point(0, 0, 0), Axis=Vector(0, 0, 1))  # -> Geometry, Transform
arc_sed = ArcSED(Start=point_a, End=point_b, Direction=unit_z)  # -> Arc, Plane, Radius
arc_3pt = Arc3Pt(PointA=point_a, PointB=point_b, PointC=point_c)  # -> Arc, Plane, Radius
arc = Arc(Plane=PlaneXY(0, 0, 0), Radius=1, Angle=Domain(0, 3.141592654))  # -> Arc, Length
biarc = BiArc(StartPoint=point_a, StartTangent=point_a, EndPoint=point_b, EndTangent=point_b, Ratio=0.5)  # -> FirstArc, SecondArc, BiArc
modified_arc = ModifiedArc(Arc=arc_sed.Arc, Radius=number_slider_2)
tangent_arcs = TangentArcs(CircleA=circle_a_2, CircleB=rotate_3d.Geometry, Radius=Slider(12, range=0..100))  # -> ArcA, ArcB
inellipse = InEllipse()  # -> Ellipse, Plane
circle = Circle(Plane=PlaneXY(0, 0, 0), Radius=1)
circle_3pt = Circle3Pt()  # -> Circle, Plane, Radius
incircle = InCircle()  # -> Circle, Plane, Radius
circle_cnr = CircleCNR(Normal=Vector(0, 0, 1), Radius=1)
ellipse = Ellipse(Plane=PlaneXY(0, 0, 0), Radius1=1, Radius2=1)  # -> Ellipse, Focus1, Focus2
circle_tantantan = CircleTanTanTan()
tangent_lines_ex = TangentLinesEx()  # -> Tangent1, Tangent2
line_sdl = LineSDL(Direction=Vector(0, 0, 1), Length=1)
line_2plane = Line2Plane()
fit_line = FitLine()
line_3 = Line()
line_4pt = Line4Pt()
tangent_lines = TangentLines()  # -> Tangent1, Tangent2
tangent_lines_in = TangentLinesIn()  # -> Tangent1, Tangent2

# ----
# Division
number_slider_3 = Slider(12, range=0..100)
number_slider_4 = Slider(6, range=0..100)
panel_2 = Panel("""0
1""")
polygon_5 = Polygon(Plane=PlaneXY(0, 0, 0), Radius=number_slider_3, Segments=Slider(4, range=0..100), FilletRadius=Slider(0, range=0..100))  # -> Polygon, Length
explode = Explode(Curve=polygon_5.Polygon, Recursive=True)  # -> Segments, Vertices
divide_length = DivideLength(Curve=polygon_5.Polygon, Length=number_slider_4)  # -> Points, Tangents, Parameters
dash_pattern = DashPattern(Curve=polygon_5.Polygon, Pattern=panel_2)  # -> Dashes, Gaps
divide_distance = DivideDistance(Curve=polygon_5.Polygon, Distance=number_slider_4)  # -> Points, Tangents, Parameters
divide_curve = DivideCurve(Curve=polygon_5.Polygon, Count=number_slider_4, Kinks=False)  # -> Points, Tangents, Parameters
shatter = Shatter(Curve=polygon_5.Polygon, Parameters=divide_curve.Parameters)
curve_frames = CurveFrames(Curve=polygon_5.Polygon, Count=number_slider_4)  # -> Frames, Parameters
geometry_3 = Geometry(dash_pattern.Gaps)
geometry_4 = Geometry(divide_curve.Tangents)
contour = Contour(Curve=polygon_5.Polygon, Point=explode.Vertices, Direction=Vector(0, 0, 1))  # -> Contours, Parameters
horizontal_frames = HorizontalFrames(Curve=polygon_5.Polygon, Count=number_slider_4)  # -> Frames, Parameters
perp_frames = PerpFrames(Curve=polygon_5.Polygon, Count=number_slider_4, Align=True)  # -> Frames, Parameters
move = Move(Geometry=geometry_3, Motion=Vector(0, 0, 10))  # -> Geometry, Transform
contour_ex = ContourEx(Plane=PlaneXY(0, 0, 0))  # -> Contours, Parameters

# ----
# Utility
join_curves = JoinCurves(Preserve=False)
explode_2 = Explode(Recursive=True)  # -> Segments, Vertices
flip_curve = FlipCurve()  # -> Curve, Flag
extend_curve = ExtendCurve(Type=0, Start=0, End=0)
offset = Offset(Distance=1, Plane=PlaneXY(0, 0, 0), Corners=1)
fillet = Fillet()  # -> Curve, Parameter
offset_loose = OffsetLoose(Distance=1)
fillet_distance = FilletDistance()
fillet_2 = Fillet()
seam = Seam()
pull_curve = PullCurve()
project = Project(Direction=Vector(0, 0, 1))
offset_on_srf = OffsetOnSrf(Distance=1)
reduce = Reduce(Tolerance=1)  # -> Polyline, Reduction
curve_to_polyline = CurveToPolyline(ToleranceDistance=0, ToleranceAngle=0)  # -> Polyline, Segments
polyline_collapse = PolylineCollapse(Tolerance=1)  # -> Polyline, Count
rebuild_curve = RebuildCurve(Count=10, Tangents=False)
fit_curve = FitCurve()
simplify_curve = SimplifyCurve()  # -> Curve, Simplified
smooth_polyline = SmoothPolyline(Strength=1, Times=1)

# ----
# Spline
start_point = StartPoint(Point(23.09854285, -16.89005679, 0))
end_point = EndPoint(Point(-19.57466267, -13.01091177, 0))
x_component = XComponent(2)
y_component = YComponent(4)
x_component_2 = XComponent(1)
y_component_2 = YComponent(4)
vector_xyz = VectorXYZ(XComponent=x_component, YComponent=y_component, ZComponent=0)  # -> Vector, Length
vector_xyz_2 = VectorXYZ(XComponent=x_component_2, YComponent=y_component_2, ZComponent=0)  # -> Vector, Length
iso_curve = IsoCurve()  # -> UIsocurve, VIsocurve
curve_on_surface = CurveOnSurface(Closed=False)  # -> Curve, Length, Domain
sub_curve = SubCurve()
geodesic = Geodesic()
tween_curve = TweenCurve(Factor=0.5, BlendType=0)
bezier_span = BezierSpan(StartPoint=start_point, StartTangent=vector_xyz.Vector, EndPoint=end_point, EndTangent=vector_xyz_2.Vector)  # -> Curve, Length, Domain
interpolate_t = InterpolateT(Degree=3, TangentStart=Vector(0, 0, 0), TangentEnd=Vector(0, 0, 0), KnotStyle=1)  # -> Curve, Length, Domain
blend_curve = BlendCurve(BulgeA=1, BulgeB=1, Continuity=2)
blend_curve_pt = BlendCurvePt(Continuity=2)
explode_3 = Explode(Curve=bezier_span.Curve, Recursive=True)  # -> Segments, Vertices
kinky_curve = KinkyCurve(Vertices=explode_3.Vertices, Degree=3, Angle=Slider(0.6, range=0..2))  # -> Curve, Length, Domain
nurbscurve = NurbsCurve()  # -> Curve, Length, Domain
interpolate = Interpolate(Vertices=explode_3.Vertices, Degree=3, Periodic=False, KnotStyle=1)  # -> Curve, Length, Domain
knot_vector = KnotVector(Degree=3, Periodic=False)
catenary = Catenary(Gravity=Vector(0, 0, -1))
connect_curves = ConnectCurves(Continuity=2, Close=True, Bulge=1)
tangent_curve = TangentCurve(Blend=0.5, Degree=3)  # -> Curve, Length, Domain
polyline = PolyLine(Vertices=explode_3.Vertices, Closed=False)
nurbs_curve = NurbsCurve(Vertices=explode_3.Vertices, Degree=3, Periodic=False)  # -> Curve, Length, Domain
polyarc = PolyArc(Vertices=explode_3.Vertices, Closed=False)
