# Grasshopper definition Oscar_first_parametric_code.gh (Grasshopper 0.9.80)
# plug-ins: Bifocals

radii_x = Slider(6, range=0..10)
number_slider = Slider(25, range=0..100)

ellipse = Ellipse(Plane=PlaneXY(0, 0, 0), Radius1=radii_x, Radius2=Slider(10, range=0..10))  # -> Ellipse, Focus1, Focus2
divide_curve = DivideCurve(Curve=ellipse.Ellipse, Count=Slider(39, range=0..100), Kinks=False)  # -> Points, Tangents, Parameters
# Doubleclick Me!
addition = Addition(A=number_slider, B=Slider(1, range=0..100))
list_item = ListItem(List=divide_curve.Points, Index=number_slider, Wrap=True)
list_item_2 = ListItem(List=divide_curve.Points, Index=addition, Wrap=True)
unit_z = UnitZ(Factor=Slider(8, range=0..100))
line = Line(StartPoint=list_item, EndPoint=list_item_2)
linear_array = LinearArray(Geometry=line, Direction=unit_z, Count=Slider(4, range=0..10))  # -> Geometry, Transform
loft = Loft(
    Curves=linear_array.Geometry,
    Options={Adjust=False, Closed=False, LoftEnds=0, LoftSimp=0, LoftType=0, Rebuild=10, Refit=0.01})
polar_array = PolarArray(Geometry=loft, Plane=PlaneXY(0, 0, 0), Count=10, Angle=6.283185307)  # -> Geometry, Transform
unit_x = UnitX(Factor=Slider(16, range=0..100))
extrude = Extrude(Base=polar_array.Geometry, Direction=unit_x)
cap_holes = CapHoles(Brep=extrude)
