# Grasshopper definition Overdone.gh (Grasshopper 0.9.80)
# plug-ins: Bifocals

unit_x = UnitX(Factor=1)
unit_y = UnitY(Factor=1)
unit_z = UnitZ(Factor=1)
xy_plane = XYPlane(Origin=Point(0, 0, 0))
yz_plane = YZPlane(Origin=Point(0, 0, 0))
xz_plane = XZPlane(Origin=Point(0, 0, 0))
point = Point(Point(0, 0, 0))
integer = Integer(1)
unit_y_2 = UnitY(Factor=1)
unit_x_2 = UnitX(Factor=Slider(4, range=0..100))
line_sdl = LineSDL(Start=point, Direction=unit_y_2, Length=Slider(12, range=0..100))
move = Move(Geometry=line_sdl, Motion=unit_x_2)  # -> Geometry, Transform
pi = Pi(Factor=Slider(0.02, range=0..1))
divide_curve = DivideCurve(Curve=move.Geometry, Count=integer, Kinks=False)  # -> Points, Tangents, Parameters
unit_z_2 = UnitZ(Factor=1)
list_item = ListItem(List=divide_curve.Points, Index=0, Wrap=True)
construct_plane = ConstructPlane(Origin=list_item, XAxis=Vector(1, 0, 0), YAxis=Vector(0, 1, 0))
construct_plane_2 = ConstructPlane(Origin=list_item, XAxis=unit_z_2, YAxis=Vector(0, 1, 0))
rotate = Rotate(Geometry=move.Geometry, Angle=expr("-x", pi), Plane=construct_plane)  # -> Geometry, Transform
pi_2 = Pi(Factor=Slider(0.03, range=0..0.25))
rotate_2 = Rotate(Geometry=rotate.Geometry, Angle=pi_2, Plane=construct_plane_2)  # -> Geometry, Transform
number_slider = Slider(1, range=0..10)
divide_curve_2 = DivideCurve(Curve=rotate_2.Geometry, Count=Slider(7, range=0..10), Kinks=False)  # -> Points, Tangents, Parameters
perp_frames = PerpFrames(Curve=rotate_2.Geometry, Count=Slider(5, range=0..10), Align=True)  # -> Frames, Parameters
list_item_2 = ListItem(List=divide_curve_2.Points, Index=number_slider, Wrap=True)
list_item_3 = ListItem(List=perp_frames.Frames, Index=number_slider, Wrap=True)
pi_3 = Pi(Factor=Slider(0.11, range=0..1))
deconstruct_plane = DeconstructPlane(Plane=list_item_3)  # -> Origin, XAxis, YAxis, ZAxis
pi_4 = Pi(Factor=Slider(0.65, range=0..1))
line_sdl_2 = LineSDL(Start=list_item_2, Direction=deconstruct_plane.XAxis, Length=Slider(24, range=0..100))
rotate_axis = RotateAxis(Geometry=list_item_3, Angle=pi_4, Axis=line_sdl_2)  # -> Geometry, Transform
rotate_3 = Rotate(Geometry=line_sdl_2, Angle=pi_3, Plane=rotate_axis.Geometry)  # -> Geometry, Transform
pipe = Pipe(Curve=[rotate_2.Geometry, rotate_3.Geometry], Radius=Slider(0.4, range=0..2), Caps=1)
mirror = Mirror(Geometry=pipe, Plane=PlaneYZ(0, 0, 0))  # -> Geometry, Transform
