# Grasshopper definition Random_WSII_2019.gh (Grasshopper 1.0.7)
# plug-ins: Bifocals

construct_domain = ConstructDomain(DomainStart=Slider(2.5, range=0..10), DomainEnd=Slider(13.8, range=0..100))
number_slider = Slider(24.2, range=0..100)
random = Random(Range=construct_domain, Number=Slider(1, range=0..100), Seed=Slider(174, range=0..1000))
pi = Pi(Factor=Slider(1.67, range=0..2))
number_slider_2 = Slider(12, range=0..100)
unit_z = UnitZ(Factor=Slider(6, range=0..100))
arc = Arc(Plane=PlaneXY(0, 0, 0), Radius=random, Angle=pi)  # -> Arc, Length
extrude = Extrude(Base=arc.Arc, Direction=unit_z)
md_slider = MDSlider(
    SliderMode=0,
    slider_value=Point(0.4095533417, 0.3394611638, 0.5),
    x_domain=Domain(0, 1),
    y_domain=Domain(0, 1),
    z_domain=Domain(0, 1))
divide_domain² = DivideDomain²(Domain=extrude, UCount=number_slider_2, VCount=number_slider_2)
isotrim = Isotrim(Surface=extrude, Domain=divide_domain²)
list_length = ListLength(List=isotrim)

construct_domain_2 = ConstructDomain(DomainStart=Slider(0, range=0..10), DomainEnd=Slider(2, range=0..2))
number_slider_3 = Slider(14, range=0..100)
random_2 = Random(Range=construct_domain_2, Number=list_length, Seed=Slider(531, range=0..1000))

evaluate_surface = EvaluateSurface(Surface=reparameterize(isotrim), Point=md_slider)  # -> Point, Normal, UDirection, VDirection, Frame
vector = Vector(evaluate_surface.Normal)
multiplication = Multiplication(A=random_2, B=vector)
extrude_2 = Extrude(Base=isotrim, Direction=expr("-x", multiplication))
brep_edges = BrepEdges(Brep=extrude_2)  # -> Naked, Interior, NonManifold
custom_preview = CustomPreview(Geometry=extrude_2, Material=ColourSwatch(SwatchColor=RGB(59, 44, 65)))
custom_preview_2 = CustomPreview(Geometry=brep_edges.Interior, Material=ColourSwatch(SwatchColor=RGB(225, 204, 65)))
