# Grasshopper definition RevolutionVessel.gh (Grasshopper 0.9.80)
# plug-ins: Bifocals

number_slider = Slider(6, range=0..100)
range = Range(Domain=Domain(0.5, 1), Steps=expr("x-1", number_slider))
series = Series(Start=0, Step=1, Count=number_slider)
construct_point = ConstructPoint(XCoordinate=series, YCoordinate=0, ZCoordinate=0)
unit_y = UnitY(Factor=range)
polyline = PolyLine(Vertices=construct_point, Closed=False)
jitter = Jitter(List=unit_y, Jitter=1, Seed=Slider(312, range=0..1000))  # -> Values, Indices
move = Move(Geometry=construct_point, Motion=jitter.Values)  # -> Geometry, Transform
polyline_2 = PolyLine(Vertices=move.Geometry, Closed=False)
pi = Pi(Factor=Slider(2, range=0..2))
revolution = Revolution(Curve=polyline_2, Axis=polyline, Domain=pi)
