# Grasshopper definition RopeLasso_WSII_2019_001.gh (Grasshopper 1.0.7)

number_slider = Slider(6, range=0..100)
number_slider_2 = Slider(9, range=0..100)
number_slider_3 = Slider(0.5, range=-0.2..0.8)
range = Range(Domain=Slider(81, range=0..1200), Steps=Slider(1200, range=0..1200))
pi = Pi(Factor=Slider(1, range=0.1..2))
xz_plane = XZPlane(Origin=Point(0, 0, 0))
sine = Sine(Value=range)
cosine = Cosine(Value=range)
unit_x = UnitX(Factor=number_slider_2)
arc = Arc(Plane=xz_plane, Radius=number_slider_2, Angle=pi)  # -> Arc, Length
construct_point = ConstructPoint(XCoordinate=sine, YCoordinate=cosine, ZCoordinate=range)
move = Move(Geometry=arc.Arc, Motion=unit_x)  # -> Geometry, Transform
polyline = PolyLine(Vertices=construct_point, Closed=False)
xy_plane = XYPlane(Origin=Point(0, 0, 0))
rotate = Rotate(Geometry=polyline, Angle=1.570796327, Plane=PlaneXY(0, 0, 0))  # -> Geometry, Transform
rotate_2 = Rotate(Geometry=rotate.Geometry, Angle=1.570796327, Plane=PlaneXY(0, 0, 0))  # -> Geometry, Transform
rotate_3 = Rotate(Geometry=rotate_2.Geometry, Angle=1.570796327, Plane=PlaneXY(0, 0, 0))  # -> Geometry, Transform
mirror = Mirror(Geometry=move.Geometry, Plane=xy_plane)  # -> Geometry, Transform
merge = Merge(Data1=rotate.Geometry, Data2=polyline, Data3=rotate_2.Geometry, Data4=rotate_3.Geometry)
merge_2 = Merge(Data1=mirror.Geometry, Data2=move.Geometry)
unit_y = UnitY(Factor=Slider(2, range=0..100))
negative = Negative(Value=unit_y)
bend_deform = BendDeform(Geometry=merge, BendingArc=move.Geometry)
xy_plane_2 = XYPlane(Origin=Point(0, 0, 0))
extrude = Extrude(Base=merge_2, Direction=negative)
extrude_2 = Extrude(Base=merge_2, Direction=unit_y)
mirror_2 = Mirror(Geometry=bend_deform, Plane=xy_plane_2)  # -> Geometry, Transform
brep_join = BrepJoin(Breps=[extrude_2, extrude])  # -> Breps, Closed
area = Area(Geometry=brep_join.Breps)  # -> Area, Centroid
deconstruct_brep = DeconstructBrep(Brep=brep_join.Breps)  # -> Faces, Edges, Vertices
scale = Scale(Geometry=brep_join.Breps, Center=area.Centroid, Factor=Slider(0.2, range=0..1))  # -> Geometry, Transform
geometry = Geometry(deconstruct_brep.Edges)
deconstruct_brep_2 = DeconstructBrep(Brep=scale.Geometry)  # -> Faces, Edges, Vertices
geometry_2 = Geometry(deconstruct_brep_2.Edges)
list_item = ListItem(List=geometry, Index=Slider(7, range=0..12), Wrap=True)
list_item_2 = ListItem(List=geometry, Index=Slider(9, range=0..12), Wrap=True)
list_item_3 = ListItem(List=geometry_2, Index=Slider(7, range=0..12), Wrap=True)
list_item_4 = ListItem(List=geometry_2, Index=Slider(9, range=0..12), Wrap=True)
loft = Loft(
    Curves=[list_item, list_item_3],
    Options={Adjust=False, Closed=False, LoftEnds=0, LoftSimp=0, LoftType=0, Rebuild=10, Refit=0.01})
loft_2 = Loft(
    Curves=[list_item_4, list_item_2],
    Options={Adjust=False, Closed=False, LoftEnds=0, LoftSimp=0, LoftType=0, Rebuild=10, Refit=0.01})
xz_plane_2 = XZPlane(Origin=Point(0, 0, 0))
brep = Brep(loft_2)
brep_2 = Brep(loft)

brep_join_2 = BrepJoin(Breps=[brep_2, brep])  # -> Breps, Closed
mirror_3 = Mirror(Geometry=brep_join_2.Breps, Plane=xz_plane_2)  # -> Geometry, Transform
brep_3 = Brep(scale.Geometry)
pipe = Pipe(Curve=mirror_2.Geometry, Radius=number_slider_3, Caps=0)
pipe_2 = Pipe(Curve=bend_deform, Radius=number_slider_3, Caps=0)
pipe_3 = Pipe(Curve=merge, Radius=number_slider_3, Caps=0)
brep_4 = Brep(brep_join.Breps)

area_2 = Area(Geometry=brep_4)  # -> Area, Centroid

sphere = Sphere(Base=area_2.Centroid, Radius=Slider(8, range=0..10))
