# Grasshopper definition Rope_WSII_2018_003.gh (Grasshopper 1.0.7)
# plug-ins: Bifocals

# Range in Set/Sequence
# Points
# Sine and Cosine
# Spline instead of Line
number_slider = Slider(36, range=0..100)
range = Range(Domain=number_slider, Steps=Slider(100, range=0..100))
sine = Sine(Value=range)
cosine = Cosine(Value=range)
construct_point = ConstructPoint(XCoordinate=sine, YCoordinate=cosine, ZCoordinate=range)
point = Point([<point referenced from the Rhino model> x6])
closest_point = ClosestPoint(Point=point, Cloud=construct_point)  # -> ClosestPoint, CPIndex, Distance
bounds = Bounds(Numbers=closest_point.Distance)
construct_domain = ConstructDomain(DomainStart=0, DomainEnd=Slider(200, range=0..200))
remap_numbers = RemapNumbers(Value=closest_point.Distance, Source=bounds, Target=construct_domain)  # -> Mapped, Clipped
line_sdl = LineSDL(Start=construct_point, Direction=Vector(0, 0, 1), Length=remap_numbers.Mapped)
polar_array = PolarArray(Plane=PlaneXY(0, 0, 0), Count=Slider(1, range=0..10), Angle=6.283185307)  # -> Geometry, Transform
pipe = Pipe(Curve=polar_array.Geometry, Radius=Slider(0.25, range=0.01..0.25), Caps=0)  # disabled
