# Grasshopper definition Rope_WSII_2018_004.gh (Grasshopper 1.0.7)
# plug-ins: Bifocals

# Range in Set/Sequence
# Points
# Sine and Cosine
# Spline instead of Line
number_slider = Slider(44, range=0..100)
range = Range(Domain=number_slider, Steps=Slider(100, range=0..100))
cosine = Cosine(Value=range)
sine = Sine(Value=range)
split_group = SplitGroup(Wrap=False)  # -> GroupA, GroupB
pi = Pi(Factor=Slider(0.5, range=0..0.5))
pi_2 = Pi(Factor=Slider(1, range=0..1))
pi_3 = Pi(Factor=Slider(1.5, range=0..1.5))
construct_point = ConstructPoint(XCoordinate=sine, YCoordinate=cosine, ZCoordinate=range)  # -> flatten(Point)
rotate = Rotate(Geometry=construct_point, Angle=pi, Plane=PlaneXY(0, 0, 0))  # -> Geometry, Transform
rotate_2 = Rotate(Geometry=construct_point, Angle=pi_2, Plane=PlaneXY(0, 0, 0))  # -> Geometry, Transform
rotate_3 = Rotate(Geometry=construct_point, Angle=pi_3, Plane=PlaneXY(0, 0, 0))  # -> Geometry, Transform
point = Point(<point referenced from the Rhino model>)
distance = Distance(PointA=construct_point, PointB=point)
distance_2 = Distance(PointA=rotate_2.Geometry, PointB=point)
distance_3 = Distance(PointA=rotate_3.Geometry, PointB=point)
distance_4 = Distance(PointA=rotate.Geometry, PointB=point)
unit_x = UnitX(Factor=distance)
unit_x_2 = UnitX(Factor=distance_2)
unit_x_3 = UnitX(Factor=distance_3)
unit_x_4 = UnitX(Factor=distance_4)
negative = Negative(Value=unit_x)
negative_2 = Negative(Value=unit_x_2)
negative_3 = Negative(Value=unit_x_3)
negative_4 = Negative(Value=unit_x_4)
move = Move(Geometry=construct_point, Motion=negative)  # -> Geometry, Transform
move_2 = Move(Geometry=rotate_2.Geometry, Motion=negative_2)  # -> Geometry, Transform
move_3 = Move(Geometry=rotate_3.Geometry, Motion=negative_3)  # -> Geometry, Transform
move_4 = Move(Geometry=rotate.Geometry, Motion=negative_4)  # -> Geometry, Transform
number_slider_2 = Slider(0.499, range=0.1..0.5)
polyline = PolyLine(Vertices=move.Geometry, Closed=False)
polyline_2 = PolyLine(Vertices=move_4.Geometry, Closed=False)
polyline_3 = PolyLine(Vertices=move_2.Geometry, Closed=False)
polyline_4 = PolyLine(Vertices=move_3.Geometry, Closed=False)
pipe = Pipe(Curve=polyline_3, Radius=number_slider_2, Caps=0)
pipe_2 = Pipe(Curve=polyline, Radius=number_slider_2, Caps=0)
pipe_3 = Pipe(Curve=polyline_2, Radius=number_slider_2, Caps=0)
pipe_4 = Pipe(Curve=polyline_4, Radius=number_slider_2, Caps=0)
