# Grasshopper definition Sculputre_WSII_2019 (1).gh (Grasshopper 1.0.7)
# plug-ins: Bifocals

number_slider = Slider(5, range=0..15)
# set one raise warped
# surface from Rhino
surface = Surface(<surface referenced from the Rhino model>)
divide_domain² = DivideDomain²(Domain=surface, UCount=Slider(11, range=0..15), VCount=number_slider)
# Isotrim
isotrim = Isotrim(Surface=surface, Domain=divide_domain²)
md_slider = MDSlider(
    SliderMode=0,
    slider_value=Point(0.3048780488, 0.3048781418, 0.5),
    x_domain=Domain(0, 1),
    y_domain=Domain(0, 1),
    z_domain=Domain(0, 1))
# Deconstruct Brep
deconstruct_brep = DeconstructBrep(Brep=isotrim)  # -> Faces, Edges, Vertices
evaluate_surface = EvaluateSurface(Surface=reparameterize(deconstruct_brep.Faces), Point=md_slider)  # -> Point, Normal, UDirection, VDirection, Frame
reverse = Reverse(Vector=evaluate_surface.Normal)
line_sdl = LineSDL(Start=evaluate_surface.Point, Direction=reverse, Length=Slider(26.732, range=0..100))
# End points
end_points = EndPoints(Curve=line_sdl)  # -> Start, End
point = Point(flatten(end_points.End))
partition_list = PartitionList(List=point, Size=number_slider)
flip_matrix = FlipMatrix(Data=partition_list)
interpolate = Interpolate(Vertices=flip_matrix, Degree=3, Periodic=False, KnotStyle=1)  # -> Curve, Length, Domain
interpolate_2 = Interpolate(Vertices=partition_list, Degree=3, Periodic=False, KnotStyle=1)  # -> Curve, Length, Domain
line = Line(StartPoint=end_points.End, EndPoint=deconstruct_brep.Vertices)
curve = Curve(deconstruct_brep.Edges)
pipe = Pipe(Curve=[interpolate.Curve, interpolate_2.Curve, line, curve], Radius=Slider(0.79, range=0..1), Caps=0)
