# Grasshopper definition SineCosine_WSII_2019.gh (Grasshopper 1.0.7)
# plug-ins: Bifocals

series = Series(Start=Slider(0, range=0..100), Step=Slider(0.08, range=0..2), Count=Slider(70, range=0..100))
series_2 = Series(Start=Slider(9, range=0..100), Step=Slider(1.52, range=0..2), Count=Slider(77, range=0..100))
sine = Sine(Value=series)
sine_2 = Sine(Value=series_2)
cosine = Cosine(Value=series_2)
multiplication = Multiplication(A=sine, B=Slider(3, range=0..100))
multiplication_2 = Multiplication(A=cosine, B=Slider(3, range=0..100))
square = Square(Value=multiplication_2)
logarithm = Logarithm(Value=series_2)
construct_point = ConstructPoint(XCoordinate=series, YCoordinate=0, ZCoordinate=multiplication)
multiplication_3 = Multiplication(A=logarithm, B=Slider(7, range=0..100))
multiplication_4 = Multiplication(A=square, B=multiplication_3)
construct_point_2 = ConstructPoint(XCoordinate=series_2, YCoordinate=multiplication, ZCoordinate=multiplication_4)
interpolate = Interpolate(Vertices=construct_point_2, Degree=3, Periodic=False, KnotStyle=1)  # -> Curve, Length, Domain
interpolate_2 = Interpolate(Vertices=construct_point, Degree=3, Periodic=False, KnotStyle=1)  # -> Curve, Length, Domain
unit_y = UnitY(Factor=Slider(46, range=0..100))
extrude = Extrude(Base=interpolate.Curve, Direction=unit_y)
unit_x = UnitX(Factor=1)
extrude_2 = Extrude(Base=extrude, Direction=unit_x)
