# Grasshopper definition SkewersWSII.gh (Grasshopper 0.9.80)
# plug-ins: Bifocals

number_slider = Slider(2.4, range=1..6)
number_slider_2 = Slider(6, range=1..6)
# play
number_slider_3 = Slider(11, range=0..100)

series = Series(Start=0, Step=number_slider_3, Count=Slider(32, range=0..100))
sine = Sine(Value=series)
multiplication = Multiplication(A=sine, B=Slider(63, range=0..100))
construct_point = ConstructPoint(XCoordinate=series, YCoordinate=0, ZCoordinate=multiplication)  # -> graft(Point)
sine_2 = Sine(Value=construct_point)
point = Point(flatten(construct_point))
multiplication_2 = Multiplication(A=sine_2, B=Slider(80, range=0..100))
construct_point_2 = ConstructPoint(XCoordinate=0, YCoordinate=construct_point, ZCoordinate=multiplication_2)  # -> graft(Point)
interpolate = Interpolate(Vertices=point, Degree=3, Periodic=False, KnotStyle=1)  # -> Curve, Length, Domain
point_2 = Point(flatten(construct_point_2))
line = Line(StartPoint=construct_point, EndPoint=construct_point_2)
interpolate_2 = Interpolate(Vertices=point_2, Degree=3, Periodic=False, KnotStyle=1)  # -> Curve, Length, Domain
sphere = Sphere(Base=point, Radius=number_slider_2)
sphere_2 = Sphere(Base=point_2, Radius=number_slider_2)
pipe = Pipe(Curve=interpolate.Curve, Radius=number_slider, Caps=0)
pipe_2 = Pipe(Curve=line, Radius=number_slider, Caps=0)
pipe_3 = Pipe(Curve=interpolate_2.Curve, Radius=number_slider, Caps=0)
brep_join = BrepJoin(Breps=[pipe, sphere, pipe_2, sphere_2, pipe_3])  # -> Breps, Closed
pi = Pi(Factor=Slider(2, range=0..2))
polar_array = PolarArray(Geometry=brep_join.Breps, Plane=PlaneXY(0, 0, 0), Count=Slider(4, range=1..6), Angle=pi)  # -> Geometry, Transform
