# Grasshopper definition Springs.gh (Grasshopper 0.9.80)
# plug-ins: Bifocals

point_x = Slider(38, range=0..100)
point_y = Slider(35, range=0..100)
point_z = Slider(68, range=0..100)

# ----
# Play
length = Slider(0.211, range=0..1)
length_2 = Slider(481, range=0..1000)
amp = Slider(19, range=0..100)
number_coils = Slider(6, range=1..6)
pipe_radii = Slider(0.12, range=0..2)

series = Series(Start=0, Step=length, Count=length_2)
sine = Sine(Value=series)
cosine = Cosine(Value=series)
multiplication = Multiplication(A=sine, B=amp)
multiplication_2 = Multiplication(A=cosine, B=amp)
construct_point = ConstructPoint(XCoordinate=series, YCoordinate=multiplication, ZCoordinate=multiplication_2)
yz_plane = YZPlane(Origin=Point(0, 0, 0))
interpolate = Interpolate(Vertices=construct_point, Degree=3, Periodic=False, KnotStyle=1)  # -> Curve, Length, Domain
polar_array = PolarArray(Geometry=interpolate.Curve, Plane=yz_plane, Count=number_coils, Angle=6.283185307)  # -> Geometry, Transform

construct_point_2 = ConstructPoint(XCoordinate=point_x, YCoordinate=point_y, ZCoordinate=point_z)
unit_x = UnitX(Factor=1)
start = Start(Point(0, 0, 0))
arc_sed = ArcSED(Start=start, End=construct_point_2, Direction=unit_x)  # -> Arc, Plane, Radius

# ----
# Disconnect and Play
bend_deform = BendDeform(Geometry=polar_array.Geometry, BendingArc=arc_sed.Arc)

# ----
# Pipe and Bake
pipe = Pipe(Curve=bend_deform, Radius=pipe_radii, Caps=0)
