# Grasshopper definition Stadium_WSII_2019.gh (Grasshopper 1.0.7)
# plug-ins: Bifocals

# Must make the general shape of the stadium in rhino first
# select surface!
surface = Surface(<surface referenced from the Rhino model>)
offset_surface = OffsetSurface(Surface=surface, Distance=Slider(0.9, range=0..1), Retrim=True)
sphere = Sphere(Base=PlaneXY(0, 0, 0), Radius=Slider(52, range=0..100))
construct_point = ConstructPoint(XCoordinate=0, YCoordinate=0, ZCoordinate=0)
populate_3d = Populate3D(Region=sphere, Count=Slider(62, range=0..100), Seed=1)
vector_2pt = Vector2Pt(PointA=construct_point, PointB=populate_3d, Unitize=False)  # -> Vector, Length
plane_normal = PlaneNormal(Origin=construct_point, ZAxis=vector_2pt.Vector)
brep_plane = BrepPlane(Brep=surface, Plane=plane_normal)  # -> Curves, Points
surface_split = SurfaceSplit(Surface=surface, Curves=flatten(brep_plane.Curves))
offset_on_srf = OffsetOnSrf(Curve=brep_plane.Curves, Distance=Slider(0.9, range=0..1), Surface=offset_surface)  # -> graft(Curve)
brep_wireframe = BrepWireframe(Brep=surface_split, Density=-1)
weave = Weave(Pattern=[0, 1], Stream0=graft(brep_plane.Curves), Stream1=offset_on_srf, NullGaps=False)
join_curves = JoinCurves(Curves=brep_wireframe, Preserve=False)
loft = Loft(Curves=weave, Options={Adjust=False, Closed=False, LoftEnds=0, LoftSimp=0, LoftType=0, Rebuild=10, Refit=0.01})
panel = Panel(loft)
divide_curve = DivideCurve(Curve=join_curves, Count=10, Kinks=False)  # -> Points, Tangents, Parameters
offset_surface_2 = OffsetSurface(Surface=loft, Distance=Slider(0.9, range=0..1), Retrim=True)
average = Average(Input=divide_curve.Points)
brep_wireframe_2 = BrepWireframe(Brep=loft, Density=-1)
brep_wireframe_3 = BrepWireframe(Brep=offset_surface_2, Density=-1)
deconstruct_vector = DeconstructVector(Vector=average)  # -> XComponent, YComponent, ZComponent
weave_2 = Weave(Pattern=[0, 1], Stream0=graft(brep_wireframe_2), Stream1=graft(brep_wireframe_3), NullGaps=False)
loft_2 = Loft(Curves=weave_2, Options={Adjust=False, Closed=False, LoftEnds=0, LoftSimp=0, LoftType=0, Rebuild=10, Refit=0.01})
larger_than = LargerThan(FirstNumber=deconstruct_vector.ZComponent, SecondNumber=Slider(106.69, range=0..200))  # -> LargerThan, OrEqualTo
geometry = Geometry(loft_2)
shift_paths = ShiftPaths(Data=loft_2, Offset=-1)
cull_pattern = CullPattern(List=surface_split, CullPattern=flatten(larger_than.LargerThan))
weave_3 = Weave(Pattern=[0, 1], Stream0=shift_paths, Stream1=loft, Stream2=offset_surface_2, NullGaps=False)
brep_join = BrepJoin(Breps=weave_3)  # -> Breps, Closed
