# Grasshopper definition Sweep1_WSII_2019.gh (Grasshopper 1.0.7)
# plug-ins: Bifocals

# reference two curves and a point
# or an area point
number_slider = Slider(0, range=0..1)
point = Point(Point(27, -4, 0))
curve = Curve(<curve referenced from the Rhino model>)
curve_2 = Curve(reparameterize(<curve referenced from the Rhino model>))
domain = Domain(curve_2)
xy_plane = XYPlane(Origin=point)
area = Area(Geometry=curve)  # -> Area, Centroid
perp_frame = PerpFrame(Curve=curve_2, Parameter=number_slider)
orient = Orient(Geometry=curve, Source=area.Centroid, Target=perp_frame)  # -> Geometry, Transform
panel = Panel(domain)
sweep1 = Sweep1(Rail=curve_2, Sections=orient.Geometry, Miter=1)
cap_holes = CapHoles(Brep=sweep1)
