# Grasshopper definition TimberMill002.gh (Grasshopper 0.9.80)
# plug-ins: Bifocals

jitter = Slider(658, range=0..1000)
# Timber Log Simulation
timber_length = Slider(10, range=0..100)
timber_length2 = Slider(29, range=0..100)
shape = Slider(63, range=0..100)
timber_dia = Slider(8, range=0..8)
number_slider = Slider(7.321, range=0.2..10)
number_slider_2 = Slider(6.995, range=0.2..10)

series = Series(Start=0, Step=timber_length, Count=timber_length2)
construct_domain = ConstructDomain(DomainStart=timber_dia, DomainEnd=expr("x+2", timber_dia))
construct_point = ConstructPoint(XCoordinate=series, YCoordinate=0, ZCoordinate=0)
negative = Negative(Value=number_slider_2)
polyline = PolyLine(Vertices=construct_point, Closed=False)
range = Range(Domain=construct_domain, Steps=shape)
negative_2 = Negative(Value=number_slider)
construct_domain_2 = ConstructDomain(DomainStart=negative, DomainEnd=number_slider_2)
construct_domain_3 = ConstructDomain(DomainStart=negative_2, DomainEnd=number_slider)
perp_frames = PerpFrames(Curve=polyline, Count=shape, Align=True)  # -> Frames, Parameters
jitter_2 = Jitter(List=range, Jitter=1, Seed=jitter)  # -> Values, Indices
deconstruct_plane = DeconstructPlane(Plane=perp_frames.Frames)  # -> Origin, XAxis, YAxis, ZAxis
circle_cnr = CircleCNR(Center=perp_frames.Frames, Normal=deconstruct_plane.ZAxis, Radius=jitter_2.Values)
area = Area(Geometry=circle_cnr)  # -> Area, Centroid
polyline_2 = PolyLine(Vertices=area.Centroid, Closed=False)
perp_frames_2 = PerpFrames(Curve=polyline_2, Count=shape, Align=True)  # -> Frames, Parameters
rectangle = Rectangle(Plane=perp_frames_2.Frames, XSize=construct_domain_3, YSize=construct_domain_2, Radius=0)  # -> Rectangle, Length
loft = Loft(
    Curves=rectangle.Rectangle,
    Options={Adjust=False, Closed=False, LoftEnds=0, LoftSimp=0, LoftType=0, Rebuild=10, Refit=0.01})
loft_2 = Loft(Curves=circle_cnr, Options={Adjust=False, Closed=False, LoftEnds=0, LoftSimp=0, LoftType=0, Rebuild=10, Refit=0.01})

cap_holes = CapHoles(Brep=loft_2)
cap_holes_2 = CapHoles(Brep=loft)

# ----
# Bake Me!
solid_intersection = SolidIntersection(BrepsA=cap_holes, BrepsB=cap_holes_2)
