# Grasshopper definition Vegetationline.gh (Grasshopper 0.9.80)
# plug-ins: Bifocals

# ---- group: ADJUST ME
line_density_ofpoints = Slider(463, range=0..1000)
crv_width_amplitude_max = Slider(0.33, range=0..3)
crv_width_amplitude_min = Slider(0.219, range=0..3)
rng_seed = Slider(123, range=0..300)
minmax_rotation_angle = Slider(19, range=0..60)

# ---- group: ASSIGN ME / Base curve from Vectorworks
crv = Curve(<curve referenced from the Rhino model>)

# ----
negative = Negative(Value=crv_width_amplitude_max)

# ---- group: DONT TOUCH / DENSITY
popgeo = PopulateGeometry(Geometry=crv, Count=line_density_ofpoints, Seed=rng_seed)
crv_cp = CurveClosestPoint(Point=popgeo, Curve=crv)  # -> Point, Parameter, Distance
hframe = HorizontalFrame(Curve=crv, Parameter=crv_cp.Parameter)

# ---- group: DONT TOUCH / CURVE WIDTH
random = Random(Range="1000", Number=line_density_ofpoints, Seed=rng_seed)
dom = ConstructDomain(DomainStart=negative, DomainEnd=crv_width_amplitude_min)
random_2 = Random(Range=dom, Number="2", Seed=random)
item = ListItem(List=random_2, Index=0, Wrap=True)  # -> Item, Item1
pt = PointOriented(BasePlane=graft(hframe), UComponent=item.Item, VComponent=item.Item1, WComponent=0)  # -> flatten(Point)

# ---- group: DONT TOUCH / ROTATION
negative_2 = Negative(Value=minmax_rotation_angle)
construct_domain = ConstructDomain(DomainStart=negative_2, DomainEnd=minmax_rotation_angle)
random_3 = Random(Range=construct_domain, Number=line_density_ofpoints, Seed=rng_seed)
line_sdl = LineSDL(Start=crv_cp.Point, Direction=Vector(0, 0, 1), Length=1)
rotate_axis = RotateAxis(Geometry=pt, Angle=degrees(random_3), Axis=line_sdl)  # -> Geometry, Transform

# ---- group: DONT TOUCH
sort_along_curve = SortAlongCurve(Points=rotate_axis.Geometry, Curve=crv)  # -> Points, Indices

# ---- group: ADJUST ME
closecrv = BooleanToggle(False)
crvdegree_curve_smoothing = Slider(3, range=0..10)

# ---- group: BAKE ME
interpolate = Interpolate(Vertices=sort_along_curve.Points, Degree=crvdegree_curve_smoothing, Periodic=closecrv, KnotStyle=1)  # -> Curve, Length, Domain
