# Grasshopper definition Voronoi3D_WSII_2019.gh (Grasshopper 1.0.7)
# plug-ins: Bifocals

number_slider = Slider(45, range=0..100)
box = Box({Plane=PlaneXY(-36, -19, 0), X=Domain(0, 30), Y=Domain(0, 55), Z=Domain(0, 17)})
point = Point([Point(-4, 1, 6.795309711), Point(4, 4, 3.733067716), Point(8, 0, 5.049135463), Point(4, -3, 3.51239839), Point(-9, -8, 0), Point(-21, -3, 2.849601055), Point(-13, 9, 0), Point(3, 8, 4.44186231), Point(8, 5, 3.354730064)])
box_2 = Box({Plane=PlaneXY(-36, -19, 0), X=Domain(0, 30), Y=Domain(0, 55), Z=Domain(0, 17)})
point_2 = Point([Point(-36, -19, 0), Point(-36, 36, 0), Point(-6, 24.45958227, 16.60397489), Point(-1.813228311, -5.401570817, -0.2540552989)])
populate_geometry = PopulateGeometry(Geometry=box, Count=number_slider, Seed=number_slider)
sphere = Sphere(Base=point_2, Radius=Slider(7, range=0..100))
sphere_2 = Sphere(Base=point, Radius=Slider(6, range=0..100))  # disabled
number_slider_2 = Slider(19, range=0..100)
solid_difference = SolidDifference(BrepsA=box_2, BrepsB=sphere)
voronoi_3d = Voronoi3D(Points=populate_geometry)  # -> Cells, Boundary
area = Area(Geometry=box_2)  # -> Area, Centroid
random_reduce = RandomReduce(List=voronoi_3d.Cells, Reduction=number_slider_2, Seed=number_slider_2)
populate_geometry_2 = PopulateGeometry(Geometry=solid_difference, Count=Slider(278, range=0..1000), Seed=1)
scale = Scale(Geometry=solid_difference, Center=area.Centroid, Factor=Slider(1.261, range=0..2))  # -> Geometry, Transform
solid_union = SolidUnion(Breps=random_reduce)
box_3 = Box(scale.Geometry)
voronoi_3d_2 = Voronoi3D(Points=populate_geometry_2, Box=box_3)  # -> Cells, Boundary
solid_intersection = SolidIntersection(BrepsA=voronoi_3d_2.Cells, BrepsB=solid_difference)  # -> graft(Result)
brep_brep = BrepBrep(BrepA=voronoi_3d_2.Cells, BrepB=solid_difference)  # -> Curves, Points
solid_union_2 = SolidUnion(Breps=solid_intersection)
deconstruct_brep = DeconstructBrep(Brep=solid_union_2)  # -> flatten(Faces), Edges, Vertices
number_slider_3 = Slider(0.82, range=0..1)
surface = Surface(deconstruct_brep.Faces)
area_2 = Area(Geometry=surface)  # -> Area, Centroid
curve = Curve(surface)
scale_2 = Scale(Geometry=curve, Center=area_2.Centroid, Factor=number_slider_3)  # -> Geometry, Transform
curve_2 = Curve(graft(curve))
curve_3 = Curve(graft(scale_2.Geometry))
scale_3 = Scale(Geometry=surface, Center=area_2.Centroid, Factor=number_slider_3)  # -> Geometry, Transform
loft = Loft(
    Curves=[curve_3, curve_2],
    Options={Adjust=False, Closed=False, LoftEnds=0, LoftSimp=0, LoftType=0, Rebuild=10, Refit=0.01})
