# Grasshopper definition Wings_WSII_2019 (1).gh (Grasshopper 1.0.7)
# plug-ins: Bifocals

number_slider = Slider(20, range=0..100)
series = Series(Start=0, Step=number_slider, Count=10)
series_2 = Series(Start=number_slider, Step=1, Count=10)
construct_point = ConstructPoint(XCoordinate=series, YCoordinate=series, ZCoordinate=series)
construct_point_2 = ConstructPoint(XCoordinate=series_2, YCoordinate=series_2, ZCoordinate=0)
reverse = Reverse(Vector=construct_point_2)
biarc = BiArc(StartPoint=construct_point, StartTangent=construct_point, EndPoint=construct_point_2, EndTangent=reverse, Ratio=0.5)  # -> FirstArc, SecondArc, BiArc
loft = Loft(Curves=biarc.SecondArc, Options={Adjust=False, Closed=False, LoftEnds=0, LoftSimp=0, LoftType=0, Rebuild=10, Refit=0.01})
loft_2 = Loft(Curves=biarc.FirstArc, Options={Adjust=False, Closed=False, LoftEnds=0, LoftSimp=0, LoftType=0, Rebuild=10, Refit=0.01})
brep_join = BrepJoin(Breps=[loft, loft_2])  # -> Breps, Closed
unit_x = UnitX(Factor=Slider(12, range=0..100))
extrude = Extrude(Base=brep_join.Breps, Direction=unit_x)
yz_plane = YZPlane(Origin=Point(0, 0, 0))
mirror = Mirror(Geometry=extrude, Plane=yz_plane)  # -> Geometry, Transform
